# Grasshopper definition 01_site_map.gh (Grasshopper 1.0.8)
# plug-ins: Alien

# Site map
# An address becomes the lot, neighbours, roads, terrain, streets, trees and massing (Vicmap, Overture).
# Each layer has its own preview in a grey from its swatch (the site boundary heaviest): change a swatch to
# restyle the map. Type another Victorian address into the map node (it suggests as you type).
vic_site_map = Alien(
    HeaderSnapshot="""# NODE_INPUTS: address:str | "Victorian street address (suggestions as you type), or lat,lon" default="201 Napier Street, Fitzroy VIC 3065" suggest="vic-address"
# NODE_INPUTS: radius:float | "context around the site (m)" min=10 max=300 default=60
# NODE_INPUTS: assumed_height:float | "height for buildings with no known height (m); 0 = leave them flat" min=0 max=60 default=7
# NODE_INPUTS: refresh:bool | "fetch again instead of using the cache" button
# NODE_INPUTS: terrain:bool | "ground from LiDAR / Vicmap elevation; buildings, streets and trees sit on it" default=true
# NODE_INPUTS: streets:bool | "3D streets: carriageways, kerbs, footpaths and nature strips in the road reserves" default=true
# NODE_INPUTS: trees:bool | "trees with measured height and canopy (metro Melbourne + Ballarat, Shepparton, Wangaratta, Sale)" default=true
# NODE_INPUTS: contour_step:float | "contour interval (m); 0 = no contours" min=0 max=10 step=0.5 default=1
# NODE_OUTPUTS: site:list[Curve] | "lot boundary", lots:list[Curve] | "neighbouring lots", roads:list[Curve] | "road centrelines", road_names:list[str] | "one per road curve"
# NODE_OUTPUTS: footprints:list[Curve] | "building footprints", buildings:list[Brep] | "extruded footprints", zone:str, overlays:list[str], info:str | "summary, sources and caveats", area:float | "site area (m2)"
# NODE_OUTPUTS: ground:Mesh | "terrain", contours:list[Curve] | "at whole multiples of contour_step (m AHD)", datum:float | "AHD height of z = 0 (m)"
# NODE_OUTPUTS: carriageway:Mesh | "road surface", footpath:Mesh | "paved verge", nature_strip:Mesh | "grass verge and medians", kerb:Mesh | "kerb faces"
# NODE_OUTPUTS: canopy:Mesh | "tree crowns", trunk:Mesh | "tree trunks"
""",
    ScriptRef="repo:suite/vic_site_map.py",
    ShowControls=True)  # -> Site, Lots, Roads, Road_names, Footprints, Buildings, Zone, Overlays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
panel = Panel(vic_site_map.Info)
panel_2 = Panel(vic_site_map.Zone)
drape_curves = Alien(
    Curves=vic_site_map.Lots,
    Ground=vic_site_map.Ground,
    HeaderSnapshot="""# NODE_INPUTS: curves:list[Curve] | "curves to lay on the ground (lot lines, a site boundary, paths)", ground:Mesh | "terrain mesh (e.g. vic_site_map's ground)"
# NODE_INPUTS: step:float | "sample spacing along each curve (m): smaller follows the ground more closely" min=0.2 max=20 default=1
# NODE_INPUTS: lift:float | "height above the ground (m), so the lines draw over it" min=0 max=2 step=0.01 default=0.05
# NODE_OUTPUTS: draped:list[Curve] | "the curves on the ground, as polylines", info:str""",
    ScriptRef="repo:demos/drape_curves.py",
    ShowControls=True)  # -> Draped, Info
drape_curves_2 = Alien(
    Curves=vic_site_map.Site,
    Ground=vic_site_map.Ground,
    HeaderSnapshot="""# NODE_INPUTS: curves:list[Curve] | "curves to lay on the ground (lot lines, a site boundary, paths)", ground:Mesh | "terrain mesh (e.g. vic_site_map's ground)"
# NODE_INPUTS: step:float | "sample spacing along each curve (m): smaller follows the ground more closely" min=0.2 max=20 default=1
# NODE_INPUTS: lift:float | "height above the ground (m), so the lines draw over it" min=0 max=2 step=0.01 default=0.05
# NODE_OUTPUTS: draped:list[Curve] | "the curves on the ground, as polylines", info:str""",
    Manual_0_Name="lift",
    Manual_0_Value="0.08",
    ScriptRef="repo:demos/drape_curves.py",
    ShowControls=True)  # -> Draped, Info
material = CreateMaterial(
    Diffuse=ColourSwatch(SwatchColor=RGB(110, 110, 110)),
    Specular=RGB(255, 254, 255),
    Emission=RGB(0, 0, 0),
    Transparency=0.25,
    Shine=0)
preview = CustomPreview(Geometry=vic_site_map.Ground, Material=ColourSwatch(SwatchColor=RGB(214, 214, 214)))
preview_2 = CustomPreview(Geometry=vic_site_map.Contours, Material=ColourSwatch(SwatchColor=RGB(150, 150, 150)))
preview_3 = CustomPreview(Geometry=vic_site_map.Buildings, Material=ColourSwatch(SwatchColor=RGB(252, 252, 252)))
preview_4 = CustomPreview(Geometry=vic_site_map.Carriageway, Material=ColourSwatch(SwatchColor=RGB(88, 88, 88)))
preview_5 = CustomPreview(Geometry=vic_site_map.Footpath, Material=ColourSwatch(SwatchColor=RGB(190, 190, 190)))
preview_6 = CustomPreview(Geometry=vic_site_map.Nature_strip, Material=ColourSwatch(SwatchColor=RGB(164, 164, 164)))
preview_7 = CustomPreview(Geometry=vic_site_map.Kerb, Material=ColourSwatch(SwatchColor=RGB(130, 130, 130)))
preview_8 = CustomPreview(Geometry=vic_site_map.Canopy, Material=material)
preview_9 = CustomPreview(Geometry=vic_site_map.Trunk, Material=ColourSwatch(SwatchColor=RGB(70, 70, 70)))
preview_10 = CustomPreview(Geometry=drape_curves.Draped, Material=ColourSwatch(SwatchColor=RGB(110, 110, 110)))
preview_11 = CustomPreview(Geometry=drape_curves_2.Draped, Material=ColourSwatch(SwatchColor=RGB(0, 0, 0)))
