# Grasshopper definition 02_object_3d.gh (Grasshopper 1.0.8)
# plug-ins: Alien

spots = Alien(
    HeaderSnapshot="""# NODE_INPUTS: x:float | "first spot along X (m)" min=-100 max=100 default=0, y:float | "first spot along Y (m)" min=-100 max=100 default=0
# NODE_INPUTS: step:float | "spacing between spots (m)" min=0 max=50 default=3
# NODE_INPUTS: along:str | "which way the spots run" default="X" options="X|Y"
# NODE_INPUTS: facing:str | "plane orientation: XY lies flat (plan, objects standing up), XZ stands up (elevations)" default="XY" options="XY|XZ"
# NODE_OUTPUTS: a:Plane | "first spot", b:Plane | "second", c:Plane | "third", d:Plane | "fourth", e:Plane | "fifth", planes:list[Plane] | "all five"
""",
    Manual_0_Name="step",
    Manual_0_Value="2.6",
    ScriptRef="repo:demos/spots.py",
    ShowControls=True)  # -> A, B, C, D, E, Planes
# 3D objects
# Describe a thing (or drop in a picture) and press generate: a model writes RhinoCommon code that
# builds it from solids at real size. The code panel shows what it wrote. Width, depth and height resize
# the built design without asking the model again; a design made before comes back free.
object_3d = Alien(
    Plane=spots.A,
    HeaderSnapshot="""# NODE_INPUTS: thing:str | "what to model" default="a dining chair", style:str | "style, materials, details (optional)" default=""
# NODE_INPUTS: image:str | "reference image: drop one on the node, or a file path or URL (optional)" default="" image, detail:str | "how much to model" default="detailed" options="simple|detailed"
# NODE_INPUTS: variant:int | "another design for the same request" min=0 max=50 default=0
# NODE_INPUTS: generate:bool | "build it with the model (paid); a design built before comes back free from the cache" button
# NODE_INPUTS: width:float | "width (m); 0 = as built" min=0 max=10 default=0, depth:float | "depth (m); 0 = as built" min=0 max=10 default=0
# NODE_INPUTS: height:float | "height (m); 0 = as built" min=0 max=10 default=0, plane:Plane | "where it stands, front facing the plane's -Y (default: world origin)"
# NODE_OUTPUTS: parts:list[Brep] | "the object's solids", names:list[str] | "part names", materials:list[str] | "material per part", colours:list[Color] | "preview colour per part"
# NODE_OUTPUTS: size:str | "width x depth x height (m)", info:str | "model, cost, attempts", code:str | "the generated build code"
""",
    Manual_0_Name="thing",
    Manual_0_Value="\"a mid-century lounge chair\"",
    Manual_1_Name="style",
    Manual_1_Value="\"walnut shell, tan leather cushions, splayed legs\"",
    ScriptRef="repo:suite/object_3d.py",
    ShowControls=True)  # -> Parts, Names, Materials, Colours, Size, Info, Code
object_3d_2 = Alien(
    Plane=spots.B,
    HeaderSnapshot="""# NODE_INPUTS: thing:str | "what to model" default="a dining chair", style:str | "style, materials, details (optional)" default=""
# NODE_INPUTS: image:str | "reference image: drop one on the node, or a file path or URL (optional)" default="" image, detail:str | "how much to model" default="detailed" options="simple|detailed"
# NODE_INPUTS: variant:int | "another design for the same request" min=0 max=50 default=0
# NODE_INPUTS: generate:bool | "build it with the model (paid); a design built before comes back free from the cache" button
# NODE_INPUTS: width:float | "width (m); 0 = as built" min=0 max=10 default=0, depth:float | "depth (m); 0 = as built" min=0 max=10 default=0
# NODE_INPUTS: height:float | "height (m); 0 = as built" min=0 max=10 default=0, plane:Plane | "where it stands, front facing the plane's -Y (default: world origin)"
# NODE_OUTPUTS: parts:list[Brep] | "the object's solids", names:list[str] | "part names", materials:list[str] | "material per part", colours:list[Color] | "preview colour per part"
# NODE_OUTPUTS: size:str | "width x depth x height (m)", info:str | "model, cost, attempts", code:str | "the generated build code"
""",
    Manual_0_Name="thing",
    Manual_0_Value="\"a dining table for six\"",
    ScriptRef="repo:suite/object_3d.py",
    ShowControls=True)  # -> Parts, Names, Materials, Colours, Size, Info, Code
object_3d_3 = Alien(
    Plane=spots.C,
    HeaderSnapshot="""# NODE_INPUTS: thing:str | "what to model" default="a dining chair", style:str | "style, materials, details (optional)" default=""
# NODE_INPUTS: image:str | "reference image: drop one on the node, or a file path or URL (optional)" default="" image, detail:str | "how much to model" default="detailed" options="simple|detailed"
# NODE_INPUTS: variant:int | "another design for the same request" min=0 max=50 default=0
# NODE_INPUTS: generate:bool | "build it with the model (paid); a design built before comes back free from the cache" button
# NODE_INPUTS: width:float | "width (m); 0 = as built" min=0 max=10 default=0, depth:float | "depth (m); 0 = as built" min=0 max=10 default=0
# NODE_INPUTS: height:float | "height (m); 0 = as built" min=0 max=10 default=0, plane:Plane | "where it stands, front facing the plane's -Y (default: world origin)"
# NODE_OUTPUTS: parts:list[Brep] | "the object's solids", names:list[str] | "part names", materials:list[str] | "material per part", colours:list[Color] | "preview colour per part"
# NODE_OUTPUTS: size:str | "width x depth x height (m)", info:str | "model, cost, attempts", code:str | "the generated build code"
""",
    ScriptRef="repo:suite/object_3d.py",
    ShowControls=True)  # -> Parts, Names, Materials, Colours, Size, Info, Code
preview = CustomPreview(
    Geometry=[object_3d.Parts, object_3d_2.Parts, object_3d_3.Parts],
    Material=[object_3d.Colours, object_3d_2.Colours, object_3d_3.Colours])
panel = Panel(object_3d.Info)
panel_2 = Panel(object_3d.Code)
