# Grasshopper definition 03_entourage_2d.gh (Grasshopper 1.0.8)
# plug-ins: Alien

spots = Alien(
    HeaderSnapshot="""# NODE_INPUTS: x:float | "first spot along X (m)" min=-100 max=100 default=0, y:float | "first spot along Y (m)" min=-100 max=100 default=0
# NODE_INPUTS: step:float | "spacing between spots (m)" min=0 max=50 default=3
# NODE_INPUTS: along:str | "which way the spots run" default="X" options="X|Y"
# NODE_INPUTS: facing:str | "plane orientation: XY lies flat (plan, objects standing up), XZ stands up (elevations)" default="XY" options="XY|XZ"
# NODE_OUTPUTS: a:Plane | "first spot", b:Plane | "second", c:Plane | "third", d:Plane | "fourth", e:Plane | "fifth", planes:list[Plane] | "all five"
""",
    Manual_0_Name="step",
    Manual_0_Value="4.5",
    Manual_1_Name="facing",
    Manual_1_Value="\"XZ\"",
    ScriptRef="repo:demos/spots.py",
    ShowControls=True)  # -> A, B, C, D, E, Planes
object_2d = Alien(
    Plane=spots.C,
    HeaderSnapshot="""# NODE_INPUTS: thing:str | "what to draw, and in plan or elevation" default="a queen bed with pillows, in plan", style:str | "drawing style (optional): fills, hatches, how much detail" default=""
# NODE_INPUTS: image:str | "reference image: drop one on the node, or a file path or URL (optional)" default="" image, detail:str | "how much to draw" default="detailed" options="simple|detailed"
# NODE_INPUTS: variant:int | "another design for the same request" min=0 max=50 default=0
# NODE_INPUTS: generate:bool | "draw it with the model (paid); a design drawn before comes back free from the cache" button
# NODE_INPUTS: width:float | "width (m, along X); 0 = as drawn" min=0 max=30 default=0, depth:float | "depth (m, along Y: length in plan, height in elevation); 0 = as drawn" min=0 max=30 default=0
# NODE_INPUTS: plane:Plane | "where it goes (default: world XY at the origin; an XZ plane stands an elevation up)"
# NODE_OUTPUTS: curves:list[Curve] | "all linework, outlines of fills and hatches included", fills:list[Brep] | "filled areas (planar)", hatches:list[Geometry] | "a solid hatch per fill and the pattern hatches, for baking"
# NODE_OUTPUTS: colours:list[Color] | "preview colour per fill", names:list[str] | "element name per curve", size:str | "width x depth (m)", info:str | "model, cost, attempts, elements", code:str | "the generated build code"
""",
    Manual_0_Name="thing",
    Manual_0_Value="\"a hatchback car, side elevation\"",
    Manual_1_Name="style",
    Manual_1_Value="\"outline with grey fills for body and windows, dark tyres\"",
    ScriptRef="repo:suite/object_2d.py",
    ShowControls=True)  # -> Curves, Fills, Hatches, Colours, Names, Size, Info, Code
# 2D entourage
# People and trees are drawn by an image model and traced into outlines and fills at true height;
# the car is drawn by code a model writes. All stand on XZ planes for elevations (spots, 4.5 m apart).
# Change who / species / thing and press generate; drawings made before come back free.
scale_figure = Alien(
    Plane=spots.A,
    HeaderSnapshot="""# NODE_INPUTS: who:str | "who, doing what" default="an adult walking", height:float | "figure height (m)" min=0.3 max=2.5 default=1.75
# NODE_INPUTS: view:str | "which way the figure faces" default="side" options="side|front|back|three-quarter", variant:int | "another drawing of the same request" min=0 max=50 default=0
# NODE_INPUTS: generate:bool | "draw it with the image model (paid); a drawing made before comes back free" button
# NODE_INPUTS: detail:float | "outline detail, 0-1" min=0 max=1 default=0.5, smooth:bool | "smooth curves (off: straight segments)" default=true
# NODE_INPUTS: plane:Plane | "where the figure stands (default: the XZ elevation plane at the origin)"
# NODE_OUTPUTS: outline:list[Curve] | "silhouette outlines, holes included", fill:list[Brep] | "filled silhouette", hatch | "solid hatch, for baking"
# NODE_OUTPUTS: info:str | "prompt, model, cost, scale", image:str | "the generated image file"
""",
    Manual_0_Name="who",
    Manual_0_Value="\"2 adults walking and a dog\"",
    ScriptRef="repo:suite/scale_figure.py",
    ShowControls=True)  # -> Outline, Fill, Hatch, Info, Image
scale_tree = Alien(
    Plane=spots.B,
    HeaderSnapshot="""# NODE_INPUTS: species:str | "kind of tree" default="mature deciduous street tree", height:float | "tree height in elevation (m)" min=0.5 max=60 default=8
# NODE_INPUTS: view:str | "elevation or plan" default="elevation" options="elevation|plan", spread:float | "canopy width in plan (m); 0 = 0.75 x height" min=0 max=60 default=0
# NODE_INPUTS: variant:int | "another drawing of the same request" min=0 max=50 default=0
# NODE_INPUTS: generate:bool | "draw it with the image model (paid); a drawing made before comes back free" button
# NODE_INPUTS: detail:float | "outline detail, 0-1" min=0 max=1 default=0.5
# NODE_INPUTS: smooth:bool | "smooth curves (off: straight segments)" default=true, plane:Plane | "where it stands (default: XZ elevation plane, or XY for plan)"
# NODE_OUTPUTS: outline:list[Curve] | "silhouette outlines, canopy gaps included", fill:list[Brep] | "filled silhouette", hatch | "solid hatch, for baking"
# NODE_OUTPUTS: info:str | "prompt, model, cost, scale", image:str | "the generated image file"
""",
    ScriptRef="repo:suite/scale_tree.py",
    ShowControls=True)  # -> Outline, Fill, Hatch, Info, Image
scale_figure_2 = Alien(
    Plane=spots.D,
    HeaderSnapshot="""# NODE_INPUTS: who:str | "who, doing what" default="an adult walking", height:float | "figure height (m)" min=0.3 max=2.5 default=1.75
# NODE_INPUTS: view:str | "which way the figure faces" default="side" options="side|front|back|three-quarter", variant:int | "another drawing of the same request" min=0 max=50 default=0
# NODE_INPUTS: generate:bool | "draw it with the image model (paid); a drawing made before comes back free" button
# NODE_INPUTS: detail:float | "outline detail, 0-1" min=0 max=1 default=0.5, smooth:bool | "smooth curves (off: straight segments)" default=true
# NODE_INPUTS: plane:Plane | "where the figure stands (default: the XZ elevation plane at the origin)"
# NODE_OUTPUTS: outline:list[Curve] | "silhouette outlines, holes included", fill:list[Brep] | "filled silhouette", hatch | "solid hatch, for baking"
# NODE_OUTPUTS: info:str | "prompt, model, cost, scale", image:str | "the generated image file"
""",
    Manual_0_Name="who",
    Manual_0_Value="\"a person riding a bicycle\"",
    ScriptRef="repo:suite/scale_figure.py",
    ShowControls=True)  # -> Outline, Fill, Hatch, Info, Image
scale_figure_3 = Alien(
    Plane=spots.E,
    HeaderSnapshot="""# NODE_INPUTS: who:str | "who, doing what" default="an adult walking", height:float | "figure height (m)" min=0.3 max=2.5 default=1.75
# NODE_INPUTS: view:str | "which way the figure faces" default="side" options="side|front|back|three-quarter", variant:int | "another drawing of the same request" min=0 max=50 default=0
# NODE_INPUTS: generate:bool | "draw it with the image model (paid); a drawing made before comes back free" button
# NODE_INPUTS: detail:float | "outline detail, 0-1" min=0 max=1 default=0.5, smooth:bool | "smooth curves (off: straight segments)" default=true
# NODE_INPUTS: plane:Plane | "where the figure stands (default: the XZ elevation plane at the origin)"
# NODE_OUTPUTS: outline:list[Curve] | "silhouette outlines, holes included", fill:list[Brep] | "filled silhouette", hatch | "solid hatch, for baking"
# NODE_OUTPUTS: info:str | "prompt, model, cost, scale", image:str | "the generated image file"
""",
    Manual_0_Name="who",
    Manual_0_Value="\"an adult walking 2 dogs\"",
    ScriptRef="repo:suite/scale_figure.py",
    ShowControls=True)  # -> Outline, Fill, Hatch, Info, Image
ln = Line(StartPoint=spots.A, EndPoint=spots.E)
swatch = ColourSwatch(SwatchColor=RGB(34, 34, 34))
panel = Panel(object_2d.Info)
preview = CustomPreview(Geometry=[scale_figure.Fill, scale_figure_2.Fill, scale_figure_3.Fill], Material=swatch)
preview_2 = CustomPreview(Geometry=scale_tree.Fill, Material=ColourSwatch(SwatchColor=RGB(128, 128, 128)))
preview_3 = CustomPreview(Geometry=object_2d.Fills, Material=object_2d.Colours)
preview_4 = CustomPreview(Geometry=[object_2d.Curves, ln], Material=swatch)
