# Grasshopper definition 04_frame_connections.gh (Grasshopper 1.0.8)
# plug-ins: Alien

# Frame and connections
# Catalogue sections (section_profile) set the columns and beams; structure_edit takes the roof beams down a
# size; connectors adds base plates, end and fin plates, bolts and welds at every joint, with a schedule.
# Try another size on either profile, or edit lines like 'B-L01-*: section=460UB67.1'.
spots = Alien(
    HeaderSnapshot="""# NODE_INPUTS: x:float | "first spot along X (m)" min=-100 max=100 default=0, y:float | "first spot along Y (m)" min=-100 max=100 default=0
# NODE_INPUTS: step:float | "spacing between spots (m)" min=0 max=50 default=3
# NODE_INPUTS: along:str | "which way the spots run" default="X" options="X|Y"
# NODE_INPUTS: facing:str | "plane orientation: XY lies flat (plan, objects standing up), XZ stands up (elevations)" default="XY" options="XY|XZ"
# NODE_OUTPUTS: a:Plane | "first spot", b:Plane | "second", c:Plane | "third", d:Plane | "fourth", e:Plane | "fifth", planes:list[Plane] | "all five"
""",
    Manual_0_Name="x",
    Manual_0_Value="-4",
    Manual_1_Name="step",
    Manual_1_Value="2",
    Manual_2_Name="along",
    Manual_2_Value="\"Y\"",
    ScriptRef="repo:demos/spots.py",
    ShowControls=True)  # -> A, B, C, D, E, Planes
section_profile = Alien(
    Plane=spots.A,
    HeaderSnapshot="""# NODE_INPUTS: family:str | "catalogue family, or custom (shape and sizes below)" default="UB" options="UB|UC|PFC|SHS|RHS|CHS|EA|UA|glulam|LVL|sawn|concrete rect|concrete round|custom"
# NODE_INPUTS: size:str | "size in the family: UB 310 40.4, UC 250 72.9, PFC 250, SHS 150x9, RHS 200x100x6, CHS 168.3x7.1, EA 75x6, UA 100x75x8, glulam 360x85 (or GL17 360x85), LVL 300x63, sawn 90x45 (or F17 190x45), concrete 600x400, round 600; or a full name like 310UB40.4 (blank: a common size; info lists the family's sizes)" default=""
# NODE_INPUTS: shape:str | "custom: the section shape" default="I" options="I|C|T|L|box|tube|rect|circle"
# NODE_INPUTS: d:float | "custom: depth (mm)" min=10 max=2000 default=300, b:float | "custom: width (mm; circle and tube: ignored)" min=10 max=2000 default=150
# NODE_INPUTS: t:float | "custom: wall thickness of box, tube and L (mm)" min=1 max=100 default=6
# NODE_INPUTS: tf:float | "custom: flange thickness of I, C and T (mm)" min=1 max=100 default=10, tw:float | "custom: web thickness of I, C and T (mm)" min=1 max=100 default=6
# NODE_INPUTS: material:str | "custom: material (sets kg/m and colour)" default="steel" options="steel|aluminium|timber|concrete"
# NODE_INPUTS: name:str | "profile name (blank: the catalogue name, or one made from the custom sizes)" default=""
# NODE_INPUTS: plane:Plane | "where the section drawing lies and the sample stands (default: world XY at the origin)"
# NODE_INPUTS: save:bool | "add this type to the Alien library" button
# NODE_OUTPUTS: profile:str | "profile record: wire into beams_columns' column or beam, or structure_edit's section", name:str | "profile name"
# NODE_OUTPUTS: outline:list[Curve] | "the section at true size on the plane: outer edge, then holes", fill:list[Brep] | "the section as a flat surface (for previews)", hatch | "solid hatch of the section (for baking)"
# NODE_OUTPUTS: dims:list[Curve] | "dimension lines, ticks and figures (mm) and the name label", sample:list[Brep] | "a 1 m length standing beside the drawing", colours:list[Color] | "colour per sample solid (also suits the fill)"
# NODE_OUTPUTS: info:str""",
    Manual_0_Name="family",
    Manual_0_Value="\"UC\"",
    Manual_1_Name="size",
    Manual_1_Value="\"250UC89.5\"",
    ScriptRef="repo:suite/section_profile.py",
    ShowControls=True)  # -> Profile, Name, Outline, Fill, Hatch, Dims, Sample, Colours, Info
section_profile_2 = Alien(
    Plane=spots.B,
    HeaderSnapshot="""# NODE_INPUTS: family:str | "catalogue family, or custom (shape and sizes below)" default="UB" options="UB|UC|PFC|SHS|RHS|CHS|EA|UA|glulam|LVL|sawn|concrete rect|concrete round|custom"
# NODE_INPUTS: size:str | "size in the family: UB 310 40.4, UC 250 72.9, PFC 250, SHS 150x9, RHS 200x100x6, CHS 168.3x7.1, EA 75x6, UA 100x75x8, glulam 360x85 (or GL17 360x85), LVL 300x63, sawn 90x45 (or F17 190x45), concrete 600x400, round 600; or a full name like 310UB40.4 (blank: a common size; info lists the family's sizes)" default=""
# NODE_INPUTS: shape:str | "custom: the section shape" default="I" options="I|C|T|L|box|tube|rect|circle"
# NODE_INPUTS: d:float | "custom: depth (mm)" min=10 max=2000 default=300, b:float | "custom: width (mm; circle and tube: ignored)" min=10 max=2000 default=150
# NODE_INPUTS: t:float | "custom: wall thickness of box, tube and L (mm)" min=1 max=100 default=6
# NODE_INPUTS: tf:float | "custom: flange thickness of I, C and T (mm)" min=1 max=100 default=10, tw:float | "custom: web thickness of I, C and T (mm)" min=1 max=100 default=6
# NODE_INPUTS: material:str | "custom: material (sets kg/m and colour)" default="steel" options="steel|aluminium|timber|concrete"
# NODE_INPUTS: name:str | "profile name (blank: the catalogue name, or one made from the custom sizes)" default=""
# NODE_INPUTS: plane:Plane | "where the section drawing lies and the sample stands (default: world XY at the origin)"
# NODE_INPUTS: save:bool | "add this type to the Alien library" button
# NODE_OUTPUTS: profile:str | "profile record: wire into beams_columns' column or beam, or structure_edit's section", name:str | "profile name"
# NODE_OUTPUTS: outline:list[Curve] | "the section at true size on the plane: outer edge, then holes", fill:list[Brep] | "the section as a flat surface (for previews)", hatch | "solid hatch of the section (for baking)"
# NODE_OUTPUTS: dims:list[Curve] | "dimension lines, ticks and figures (mm) and the name label", sample:list[Brep] | "a 1 m length standing beside the drawing", colours:list[Color] | "colour per sample solid (also suits the fill)"
# NODE_OUTPUTS: info:str""",
    Manual_0_Name="size",
    Manual_0_Value="\"410UB53.7\"",
    ScriptRef="repo:suite/section_profile.py",
    ShowControls=True)  # -> Profile, Name, Outline, Fill, Hatch, Dims, Sample, Colours, Info
grids = Alien(
    HeaderSnapshot="""# NODE_INPUTS: site:object | "site record from bim_site: grids start at its origin and run along its rotation"
# NODE_INPUTS: boundary:Curve | "optional boundary curve: overrides the site's boundary; grids fit its footprint"
# NODE_INPUTS: fit:bool | "fit grids to the boundary footprint" default=true, margin:float | "inset from the boundary (m)" min=0 max=20 default=0
# NODE_INPUTS: x_spacing:str | "bays along project X (m): '7.2, 7.2, 8.4', '3x7.2', or 'fit' / 'fit 7.2' to divide the boundary width" default="fit 7.2", y_spacing:str | "bays along project Y (m): same, 'fit 6' divides the boundary depth" default="fit 6"
# NODE_INPUTS: labels:str | "numbered or lettered grids along X (the other way gets the other)" default="numbers along X" options="numbers along X|letters along X"
# NODE_INPUTS: x_start:str | "first label of the grids along X ('1', '4', 'C', 'X1')" default="1", y_start:str | "first label of the grids along Y" default="A"
# NODE_INPUTS: skip_io:bool | "skip I and O in letters (they read as 1 and 0)" default=true, extension:float | "grid lines run past the outermost grids (m)" min=0 max=20 default=3
# NODE_INPUTS: bubble:float | "head diameter on paper (mm) at the drawing scale" min=4 max=30 step=0.5 default=10, ends:str | "heads at" default="both" options="both|start|end|none"
# NODE_INPUTS: scale:str | "drawing scale of the heads and dimensions" default="site" options="site|1:50|1:100|1:200|1:500"
# NODE_INPUTS: custom:list[Curve] | "extra grids: angled or curved curves (optional)", custom_names:list[str] | "names of the custom grids (default G1, G2 ...)"
# NODE_INPUTS: dimensions:bool | "bay and overall dimension strings (mm) on the start sides" default=true
# NODE_OUTPUTS: grids:list[str] | "grid records: wire into the building nodes' grids input", lines:list[Curve] | "grid lines", heads:list[Curve] | "bubbles: circle and name"
# NODE_OUTPUTS: names:list[str] | "one per grid line", points:list[Point3d] | "grid intersections", point_names:list[str] | "'A/1' ...", dims:list[Curve] | "dimension linework"
# NODE_OUTPUTS: outline:Curve | "footprint: the rectangle on the outermost grids, for walls, slabs, roofs and levels' outline", edges:list[Curve] | "the footprint's sides as wall lines (exterior on their left, as walls reads them): front, left, back, right", info:str""",
    Manual_0_Name="x_spacing",
    Manual_0_Value="\"2x7.2\"",
    Manual_1_Name="y_spacing",
    Manual_1_Value="\"6\"",
    ScriptRef="repo:suite/grids.py",
    ShowControls=True)  # -> Grids, Lines, Heads, Names, Points, Point_names, Dims, Outline, Edges, Info
levels = Alien(
    HeaderSnapshot="""# NODE_INPUTS: count:int | "storeys from the ground up" min=1 max=100 default=4, height:float | "floor-to-floor height (m)" min=0.5 max=20 default=3.2
# NODE_INPUTS: heights:list[str] | "per-storey heights (m), from the lowest up, e.g. '4.5, 3, , 3.6' (a blank keeps height)"
# NODE_INPUTS: base:float | "ground level above the site origin (m)" min=-20 max=50 default=0, outline:Curve | "floor plate to copy to every storey (optional; else the site boundary or a 20 x 12 m sample)"
# NODE_INPUTS: site:object | "site record from bim_site: places the levels, datum gives RLs, scale sizes the text"
# NODE_INPUTS: naming:str | "level names" default="Level 1" options="Level 1|L1|L01|Level 01|LVL 1|custom", prefix:str | "custom names: prefix + number, or # for the number ('Floor #', '##F' gives 01F)" default="Floor #"
# NODE_INPUTS: start:int | "number of the first numbered level" min=-5 max=100 default=1, ground:str | "name of the ground level" default="Ground" options="Ground|Ground Floor|GF|G|numbered"
# NODE_INPUTS: basements:int | "storeys below ground (Basement 1 is just below)" min=0 max=10 default=0, roof_level:bool | "add a Roof level on top of the last storey" default=true
# NODE_INPUTS: view:str | "level lines for which elevations" default="both" options="front (along X)|side (along Y)|both", ends:str | "level heads at" default="right" options="right|left|both|none"
# NODE_INPUTS: margin:float | "level lines run past the floor plates (m)" min=0 max=20 default=2, scale:str | "drawing scale of the annotation" default="site" options="site|1:50|1:100|1:200|1:500"
# NODE_INPUTS: text:float | "text height on paper (mm) at the drawing scale" min=1 max=10 step=0.5 default=3.5
# NODE_OUTPUTS: planes:list[Plane] | "one per storey", elevations:list[float] | "storey z (m)", floor_heights:list[float] | "floor-to-floor of each storey (m)"
# NODE_OUTPUTS: names:list[str] | "storey names", plates:list[Curve] | "floor plate at each storey", roof:Plane | "top of the last storey", total:float | "ground to roof (m)"
# NODE_OUTPUTS: levels:list[str] | "level records, storeys and roof: wire into the building nodes' levels input", lines:list[Curve] | "level lines for elevations and sections"
# NODE_OUTPUTS: heads:list[Curve] | "level heads: datum symbol, name and RL at the line ends", annotations:list[Curve] | "plan label on each level: 'LEVEL 1  RL +3.200'"
# NODE_OUTPUTS: labels:list[str] | "one per level", rl:list[float] | "reduced level of each level (m): datum + elevation", info:str""",
    Manual_0_Name="count",
    Manual_0_Value="2",
    Manual_1_Name="height",
    Manual_1_Value="3.6",
    ScriptRef="repo:suite/levels.py",
    ShowControls=True)  # -> Planes, Elevations, Floor_heights, Names, Plates, Roof, Total, Levels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
beams_columns = Alien(
    Grids=grids.Grids,
    Levels=levels.Levels,
    Column=section_profile.Profile,
    Beam=section_profile_2.Profile,
    HeaderSnapshot="""# NODE_INPUTS: grids:list[object] | "grid records (from grids); sample grids when unwired", levels:list[object] | "level records (from levels); sample levels when unwired"
# NODE_INPUTS: column:str | "column section: 310UC96.8, SHS 150x9, CHS 168.3x7.1, GL18 360x360, concrete 450x450, or a profile record from section_profile (blank: the material's default)" default=""
# NODE_INPUTS: beam:str | "beam section: 410UB53.7, 250PFC, RHS 200x100x6, LVL 360x63, concrete 600x400, or a profile record from section_profile (blank: the material's default)" default=""
# NODE_INPUTS: material:str | "frame material: picks the default sections and reads bare sizes like 400x400" default="steel" options="steel|timber|concrete"
# NODE_INPUTS: columns_at:str | "where columns go" default="all intersections" options="all intersections|perimeter|none", skip:str | "intersections left without a column, e.g. 'B/2, C/3'" default=""
# NODE_INPUTS: beams_on:str | "grid lines that get beams" default="both" options="both|letters|numbers|none"
# NODE_INPUTS: from_level:str | "lowest level: name, code or index (blank: the lowest)" default="", to_level:str | "top level (blank: the highest)" default=""
# NODE_INPUTS: rotation:float | "column rotation (degrees) on top of the grid's angle" min=-180 max=180 default=0, top_offset:float | "beam tops below each level (m), e.g. the slab thickness" min=0 max=1.5 default=0.15
# NODE_INPUTS: site:object | "site record (optional): unwired sample grids sit on its origin and rotation"
# NODE_OUTPUTS: members:list[str] | "member records: wire into structure_edit or connectors", solids:list[Brep] | "every member, in member order"
# NODE_OUTPUTS: columns:list[Brep], beams:list[Brep], axes:list[Curve] | "member centrelines", names:list[str] | "member ids, e.g. C-A/1-GF, B-L01-A-1/2"
# NODE_OUTPUTS: sections:list[str] | "section name per member", colours:list[Color] | "preview colour per member (wire with solids into Custom Preview)", info:str""",
    ScriptRef="repo:suite/beams_columns.py",
    ShowControls=True)  # -> Members, Solids, Columns, Beams, Axes, Names, Sections, Colours, Info
structure_edit = Alien(
    Members=beams_columns.Members,
    HeaderSnapshot="""# NODE_INPUTS: members:list[object] | "member records (from beams_columns or another structure_edit); a sample frame when unwired"
# NODE_INPUTS: select:str | "members to edit: ids with * wildcards (C-A/*, B-L02-*) and/or filters level=L02 grid=A role=beam section=310UC* material=steel; blank = none, * = all" default=""
# NODE_INPUTS: action:str | "what to do to the selection" default="resize" options="resize|move|rotate|remove|extend"
# NODE_INPUTS: section:str | "resize to: a section name (460UB67.1, SHS 200x9, GL18 450x135), a profile record from section_profile, or up / down a size" default="", offset:str | "move by: dx, dy, dz (m)" default="0, 0, 0"
# NODE_INPUTS: rotation:float | "rotate by (degrees) about each member's own axis" min=-180 max=180 default=0, extend:float | "extend both ends by (m); negative shortens" min=-3 max=3 default=0
# NODE_INPUTS: edits:list[str] | "more edits, one per line, in order: 'B-L02-*: section=460UB67.1', 'C-B/2-*: remove', 'level=RF role=beam: move=0,0,0.1 rotate=5', 'C-A/1-GF: extend=0.5,0'"
# NODE_OUTPUTS: members:list[str] | "member records, ids kept (wire into connectors)", solids:list[Brep] | "every member, in member order", columns:list[Brep], beams:list[Brep]
# NODE_OUTPUTS: colours:list[Color] | "preview colour per solid: edited members green", changed:list[str] | "ids of members that changed (edited, or beams refitted to an edited support)", info:str""",
    Manual_0_Name="select",
    Manual_0_Value="\"level=RF role=beam\"",
    Manual_1_Name="section",
    Manual_1_Value="\"down\"",
    ScriptRef="repo:suite/structure_edit.py",
    ShowControls=True)  # -> Members, Solids, Columns, Beams, Colours, Changed, Info
connectors = Alien(
    Members=structure_edit.Members,
    HeaderSnapshot="""# NODE_INPUTS: members:list[object] | "member records (from beams_columns or structure_edit); a sample frame when unwired"
# NODE_INPUTS: type:str | "connector: auto picks one per joint; any other makes only that kind (every beam end as an end plate, fin plate or cleat)" default="auto" options="auto|base plate|cap plate|end plate|fin plate|cleat"
# NODE_INPUTS: thickness:float | "plate thickness (mm); 0 = by joint: base 25, cap 16, end 12, fin 10, cleat 10, splice 12" min=0 max=60 default=0
# NODE_INPUTS: bolt:str | "bolt size (and anchor size at base plates)" default="M20" options="M16|M20|M24"
# NODE_INPUTS: rows:int | "bolt rows (0 = as many as fit)" min=0 max=12 default=0, cols:int | "bolt columns (0 = by joint: 2 across end and base plates, 1 along fin plates and cleats)" min=0 max=6 default=0
# NODE_INPUTS: edge:float | "bolt edge distance (mm)" min=20 max=100 default=40, margin:float | "base plate beyond the column (mm)" min=0 max=300 default=100
# NODE_INPUTS: welds:bool | "preview fillet welds" default=false
# NODE_OUTPUTS: plates:list[Brep] | "plates, cleats and stiffeners", bolts:list[Brep] | "bolts and anchors", welds:list[Brep] | "fillet welds (with welds on)"
# NODE_OUTPUTS: solids:list[Brep] | "plates, bolts and welds together, for one Custom Preview", joints:list[str] | "joint records: id, kind, members, plate, bolts"
# NODE_OUTPUTS: schedule:list[str] | "one line per joint, e.g. BP A/1 GF: PL 505x508x25, 4 M24 anchors", colours:list[Color] | "preview colour per solid", info:str""",
    Manual_0_Name="welds",
    Manual_0_Value="true",
    ScriptRef="repo:suite/connectors.py",
    ShowControls=True)  # -> Plates, Bolts, Welds, Solids, Joints, Schedule, Colours, Info
panel = Panel(connectors.Schedule)
preview = CustomPreview(Geometry=structure_edit.Solids, Material=structure_edit.Colours)
preview_2 = CustomPreview(Geometry=connectors.Solids, Material=connectors.Colours)
preview_3 = CustomPreview(
    Geometry=[section_profile.Fill, section_profile_2.Fill, section_profile.Sample, section_profile_2.Sample],
    Material=ColourSwatch(SwatchColor=RGB(70, 92, 120)))
