# Grasshopper definition 05_attractor_facade.gh (Grasshopper 1.0.8)
# plug-ins: Alien

# Attractor facade
# A perforated rainscreen on a curved facade: openings swell towards the attractor and panels darken with
# them. Drag u and v to move the attractor, or click 'attractor' and pick a point in Rhino; wire your own
# surface into facade. Shape, reach, sizes, panel count, depth and joints are all on the node.
attractor_facade = Alien(
    HeaderSnapshot="""# NODE_INPUTS: facade:Brep | "facade surface (a curved 30 x 14 m sample when unwired)", attractor:Point3d | "attractor point (wired or clicked); unwired: u and v place it on the facade"
# NODE_INPUTS: u:float | "attractor along the facade, 0-1 (when no point is given)" min=0 max=1 step=0.01 default=0.3
# NODE_INPUTS: v:float | "attractor up the facade, 0-1 (when no point is given)" min=0 max=1 step=0.01 default=0.55
# NODE_INPUTS: columns:int | "panels across" min=2 max=60 default=24, rows:int | "panels up" min=1 max=30 default=10
# NODE_INPUTS: shape:str | "opening shape" default="circle" options="circle|square|diamond|slot"
# NODE_INPUTS: smallest:float | "opening size far from the attractor, share of the panel" min=0 max=0.95 step=0.01 default=0.08
# NODE_INPUTS: largest:float | "opening size at the attractor, share of the panel" min=0.05 max=0.95 step=0.01 default=0.86
# NODE_INPUTS: reach:float | "how far the attractor's pull reaches (m)" min=1 max=60 default=12
# NODE_INPUTS: invert:bool | "largest openings far from the attractor instead" default=false
# NODE_INPUTS: depth:float | "panel thickness (mm)" min=2 max=300 default=40, joint:float | "open joint between panels (mm)" min=0 max=300 default=30
# NODE_OUTPUTS: panels:list[Brep] | "perforated panels, one per cell", colours:list[Color] | "colour per panel: darker where it is more open"
# NODE_OUTPUTS: glass:list[Brep] | "glazing set back behind the panels", openings:list[Curve] | "opening outlines", openness:list[float] | "opening size per panel, 0-1"
# NODE_OUTPUTS: point:Point3d | "the attractor used", info:str""",
    Manual_0_Name="u",
    Manual_0_Value="0.32",
    Manual_1_Name="v",
    Manual_1_Value="0.6",
    Manual_2_Name="reach",
    Manual_2_Value="11",
    ScriptRef="repo:demos/attractor_facade.py",
    ShowControls=True)  # -> Panels, Colours, Glass, Openings, Openness, Point, Info
material = CreateMaterial(
    Diffuse=ColourSwatch(SwatchColor=RGB(150, 185, 205)),
    Specular=RGB(255, 254, 255),
    Emission=RGB(0, 0, 0),
    Transparency=0.55,
    Shine=0)
preview = CustomPreview(Geometry=attractor_facade.Panels, Material=attractor_facade.Colours)
panel = Panel(attractor_facade.Info)
preview_2 = CustomPreview(Geometry=attractor_facade.Glass, Material=material)
preview_3 = CustomPreview(Geometry=attractor_facade.Point, Material=ColourSwatch(SwatchColor=RGB(200, 40, 40)))
