# Grasshopper definition 06_texture_material.gh (Grasshopper 1.0.8)
# plug-ins: Alien

tile_size_m = Slider(1.2, range=0.2..4)
# Texture to material
# An image model paints a tileable texture for a finish; the node makes it seamless, a display material for
# previews, and (press add) a PBR render material in Rhino at the same real size. texture_mapping gives any
# geometry real-size coordinates, so one slider sets the tile size for both.
material_texture = Alien(
    Size=tile_size_m,
    HeaderSnapshot="""# NODE_INPUTS: finish:str | "the material finish" default="board-formed concrete", size:float | "real-world size one tile covers (m)" min=0.05 max=20 default=1.2
# NODE_INPUTS: variant:int | "another texture for the same finish" min=0 max=50 default=0, seamless:bool | "blend the edges so tiles repeat without seams" default=true
# NODE_INPUTS: generate:bool | "paint it with the image model (paid); a texture painted before comes back free" button
# NODE_INPUTS: add:bool | "add (or update) the material in the Rhino document" button, name:str | "material name (default: the finish)" default=""
# NODE_OUTPUTS: material | "display material: wire into Custom Preview", preview:list[Brep] | "3 x 3 tiles at real size, to see the repeat"
# NODE_OUTPUTS: texture:str | "texture image file", name:str | "material name", info:str | "model, cost, seam check"
""",
    Manual_0_Name="finish",
    Manual_0_Value="\"rough sawn cedar cladding boards\"",
    ScriptRef="repo:suite/material_texture.py",
    ShowControls=True)  # -> Material, Preview, Texture, Name, Info
texture_mapping = Alien(
    Size=tile_size_m,
    HeaderSnapshot="""# NODE_INPUTS: geometry:list[Geometry] | "Breps, extrusions or meshes to map (a sample wall, plinth and bench when unwired)"
# NODE_INPUTS: size:float | "real-world size of one texture tile (m): wire the material node's size" min=0.05 max=20 default=1.2
# NODE_INPUTS: mapping:str | "how the texture is laid on: box projects each face from its main direction, planar from above" default="box" options="box|planar"
# NODE_INPUTS: rotate:float | "turn the texture on each face (degrees), e.g. 90 to run boards vertically" min=-180 max=180 default=0
# NODE_OUTPUTS: meshes:list[Mesh] | "the geometry as meshes with texture coordinates at real size: wire into Custom Preview with the material"
# NODE_OUTPUTS: info:str""",
    ScriptRef="repo:demos/texture_mapping.py",
    ShowControls=True)  # -> Meshes, Info
preview = CustomPreview(Geometry=texture_mapping.Meshes, Material=material_texture.Material)
panel = Panel(material_texture.Info)
