# Grasshopper definition 07_exploded_axo.gh (Grasshopper 1.0.8)
# plug-ins: Alien

# ---- group: House
# Exploded axo
# The building tool's house (the project agent places it from one request), with its walls, openings,
# slabs, stair, balustrades and roof pulled apart by storey (height bands) beside the original, with dashed
# explosion lines and labels. Press view on the axo node for a parallel isometric named view.
bim_site = Alien(
    HeaderSnapshot="""# NODE_INPUTS: name:str | "project name" default="Project", boundary:list[Curve] | "site boundary, e.g. vic_site_map's site (optional; several lots are joined)"
# NODE_INPUTS: origin:Point3d | "project base point (optional; else set by anchor)", anchor:str | "where the origin goes when none is wired" default="corner" options="corner|centre|world origin"
# NODE_INPUTS: rotation:float | "project grid rotation (deg, CCW from world X); with align, turns the aligned grid further" min=-180 max=180 default=0 decimals=1
# NODE_INPUTS: align:str | "take the grid direction from the boundary" default="off" options="off|long axis|longest edge"
# NODE_INPUTS: north:float | "true north (deg, CCW from world +Y; 0 for vic_site_map)" min=-180 max=180 default=0 decimals=1
# NODE_INPUTS: datum:float | "AHD (m) of model z = 0: wire vic_site_map's datum" min=-20 max=2000 default=0 decimals=3
# NODE_INPUTS: scale:str | "drawing scale for the suite's annotation (levels, grids, symbols)" default="1:100" options="1:50|1:100|1:200|1:500|1:1000"
# NODE_OUTPUTS: site:str | "site record: wire into the building nodes' site input", plane:Plane | "project plane: at the origin, X along the grid"
# NODE_OUTPUTS: boundary:list[Curve] | "the joined site boundary", arrow:list[Curve] | "north point (true north; a PN tick when the grid is turned)"
# NODE_OUTPUTS: marker:list[Curve] | "project base point: circle, cross, X/Y axes, datum", info:str""",
    Manual_0_Name="name",
    Manual_0_Value="\"House\"",
    Manual_1_Name="origin",
    Manual_1_Value="[0.0,0.0,0]",
    ScriptRef="repo:suite/bim_site.py",
    ShowControls=True)  # -> Site, Plane, Boundary, Arrow, Marker, Info
wall_types = Alien(
    Plane=bim_site.Plane,
    HeaderSnapshot="""# NODE_INPUTS: preset:str | "a common Australian build-up, or custom (from layers)" default="brick veneer" options="brick veneer|double brick|timber stud|steel stud partition|concrete 200|precast 150|blockwork 190|CLT|rendered AAC|custom"
# NODE_INPUTS: name:str | "type name (blank: the preset's)" default=""
# NODE_INPUTS: layers:list[str] | "layers exterior -> interior, thickness in mm: 'brick 110; cavity 40; timber stud 90*; plasterboard 10' (* = core). Replaces the preset's layers when given" default=""
# NODE_INPUTS: plane:Plane | "where the swatch sits (default: world origin)"
# NODE_INPUTS: save:bool | "add this type to the Alien library" button
# NODE_OUTPUTS: wall_type:str | "wall_type record for walls", names:list[str] | "layer names, exterior first", materials:list[str] | "layer materials", thicknesses:list[float] | "layer thicknesses (m)"
# NODE_OUTPUTS: total:float | "overall thickness (m)", swatch:list[Brep] | "a stepped section sample, one solid per layer", colours:list[Color] | "colour per swatch solid", info:str""",
    ScriptRef="repo:suite/wall_types.py",
    ShowControls=True)  # -> Wall_type, Names, Materials, Thicknesses, Total, Swatch, Colours, Info
slab_types = Alien(
    Plane=bim_site.Plane,
    HeaderSnapshot="""# NODE_INPUTS: preset:str | "a common floor build-up, or custom (from layers)" default="concrete 200" options="concrete 200|post-tensioned 250|hollowcore 200 + topping|CLT 180 + screed|timber joist floor|waffle 300|steel deck composite 150|slab on ground 100|custom"
# NODE_INPUTS: name:str | "type name (blank: from the preset, finish and soffit)" default=""
# NODE_INPUTS: layers:list[str] | "layers top -> bottom, thickness in mm: 'screed 50; CLT 180*; plasterboard ceiling 13' (* = structure). Replaces the preset's layers when given" default=""
# NODE_INPUTS: finish:str | "floor finish laid on top" default="none" options="none|polished concrete|tiles|timber boards|carpet|vinyl|screed|raised floor"
# NODE_INPUTS: soffit:str | "underside: as built keeps the build-up's own; the others replace its ceiling" default="as built" options="as built|exposed|plasterboard|suspended ceiling|render|acoustic panels"
# NODE_INPUTS: plane:Plane | "where the swatch sits (default: world origin)", save:bool | "add this type to the Alien library" button
# NODE_OUTPUTS: slab_type:str | "slab_type record for slabs", names:list[str] | "layer names, top first", materials:list[str] | "layer materials", thicknesses:list[float] | "layer thicknesses (m)"
# NODE_OUTPUTS: total:float | "overall thickness (m)", swatch:list[Brep] | "a stepped sample, one solid per layer", colours:list[Color] | "colour per swatch solid", info:str""",
    ScriptRef="repo:suite/slab_types.py",
    ShowControls=True)  # -> Slab_type, Names, Materials, Thicknesses, Total, Swatch, Colours, Info
roof_types = Alien(
    Plane=bim_site.Plane,
    HeaderSnapshot="""# NODE_INPUTS: preset:str | "a common roof build-up, or custom (from layers)" default="metal deck" options="metal deck|metal deck low pitch|concrete tile|terracotta tile|slate|membrane on concrete|green roof|custom"
# NODE_INPUTS: name:str | "type name (blank: the preset's)" default=""
# NODE_INPUTS: layers:list[str] | "layers top -> bottom, thickness in mm: 'metal roofing 20; battens 40; insulation 55; rafters 140*' (* = structure). Replaces the preset's layers when given" default=""
# NODE_INPUTS: colour:str | "colour of the roofing (the top layer)" default="as built" options="as built|charcoal|dark grey|mid grey|light grey|off-white|red|terracotta|green|blue"
# NODE_INPUTS: plane:Plane | "where the swatch sits (default: world origin)", save:bool | "add this type to the Alien library" button
# NODE_OUTPUTS: roof_type:str | "roof_type record for roofs", names:list[str] | "layer names, top first", materials:list[str] | "layer materials", thicknesses:list[float] | "layer thicknesses (m)"
# NODE_OUTPUTS: total:float | "overall thickness, square to the roof (m)", swatch:list[Brep] | "a stepped sample, one solid per layer", colours:list[Color] | "colour per swatch solid", info:str""",
    ScriptRef="repo:suite/roof_types.py",
    ShowControls=True)  # -> Roof_type, Names, Materials, Thicknesses, Total, Swatch, Colours, Info
balustrade_types = Alien(
    Plane=bim_site.Plane,
    HeaderSnapshot="""# NODE_INPUTS: style:str | "infill" default="glass and posts" options="frameless glass|glass and posts|vertical bars|horizontal rails|wires|solid sheet|timber"
# NODE_INPUTS: name:str | "type name (blank: from the style and height)" default=""
# NODE_INPUTS: height:float | "height to the top on floors and landings (m); NCC at least 1.0" min=0.5 max=2 default=1.0
# NODE_INPUTS: stair_height:float | "height above the nosing line along stair flights (m); NCC at least 0.865; 0 = as height" min=0 max=2 default=0
# NODE_INPUTS: posts:float | "post spacing (m); frameless glass: the pane width" min=0.3 max=3 default=1.2, post:float | "post size (mm), square; 0 = by style (50, timber 90)" min=0 max=200 default=0
# NODE_INPUTS: gap:float | "clear gap between bars, rails or wires (mm); NCC at most 125" min=10 max=300 default=100, bottom:float | "gap under the infill (mm); NCC at most 125" min=0 max=300 default=50
# NODE_INPUTS: handrail:str | "handrail on top" default="by style" options="by style|round 50|round 42|square 50|rect 65x20|timber 70x42|none"
# NODE_INPUTS: infill:float | "glass or sheet thickness, bar or rail size (mm); 0 = by style" min=0 max=60 default=0
# NODE_INPUTS: plane:Plane | "where the swatch sits (default: world origin)", save:bool | "add this type to the Alien library" button
# NODE_OUTPUTS: balustrade_type:str | "balustrade_type record for balustrades", swatch:list[Brep] | "a sample run: 1.2 m on a floor, then up a stair pitch", colours:list[Color] | "colour per swatch solid"
# NODE_OUTPUTS: elevation:list[Curve] | "the swatch's front outlines", info:str""",
    ScriptRef="repo:suite/balustrade_types.py",
    ShowControls=True)  # -> Balustrade_type, Swatch, Colours, Elevation, Info
stair_types = Alien(
    Plane=bim_site.Plane,
    HeaderSnapshot="""# NODE_INPUTS: construction:str | "how the stair is built" default="concrete in-situ" options="concrete in-situ|steel stringers|timber|precast"
# NODE_INPUTS: use:str | "sets the NCC limits: public / commercial (Vol 1) or private / domestic (Vol 2)" default="public / commercial" options="public / commercial|private / domestic"
# NODE_INPUTS: name:str | "type name (blank: from the construction and sizes)" default=""
# NODE_INPUTS: riser:float | "target riser (mm): each stair rounds it to a whole number of risers; NCC 115–190" min=100 max=250 default=175
# NODE_INPUTS: going:float | "going (mm), nosing to nosing; NCC 250–355 public, 240–355 private" min=150 max=450 default=280
# NODE_INPUTS: tread:float | "tread thickness (mm): steel and timber" min=5 max=100 default=40, nosing:float | "nosing projection (mm): steel and timber" min=0 max=50 default=20
# NODE_INPUTS: waist:float | "waist and landing slab thickness (mm): concrete and precast" min=80 max=400 default=175
# NODE_INPUTS: stringer:str | "stringer depth x thickness in mm, e.g. '250x12' (blank: steel 250x12 plate, timber 290x45)" default=""
# NODE_INPUTS: risers:str | "riser boards (steel and timber; concrete steps are always closed)" default="closed" options="closed|open"
# NODE_INPUTS: plane:Plane | "where the swatch sits (default: world origin)", save:bool | "add this type to the Alien library" button
# NODE_OUTPUTS: stair_type:str | "stair_type record for stairs", swatch:list[Brep] | "four steps and a landing edge, 1 m wide", colours:list[Color] | "colour per swatch solid"
# NODE_OUTPUTS: section:list[Curve] | "the swatch cut through its middle (stringers seen beyond)", info:str""",
    Manual_0_Name="use",
    Manual_0_Value="\"private / domestic\"",
    Manual_1_Name="riser",
    Manual_1_Value="180.0",
    Manual_2_Name="going",
    Manual_2_Value="250.0",
    ScriptRef="repo:suite/stair_types.py",
    ShowControls=True)  # -> Stair_type, Swatch, Colours, Section, Info
grids = Alien(
    Site=bim_site.Site,
    HeaderSnapshot="""# NODE_INPUTS: site:object | "site record from bim_site: grids start at its origin and run along its rotation"
# NODE_INPUTS: boundary:Curve | "optional boundary curve: overrides the site's boundary; grids fit its footprint"
# NODE_INPUTS: fit:bool | "fit grids to the boundary footprint" default=true, margin:float | "inset from the boundary (m)" min=0 max=20 default=0
# NODE_INPUTS: x_spacing:str | "bays along project X (m): '7.2, 7.2, 8.4', '3x7.2', or 'fit' / 'fit 7.2' to divide the boundary width" default="fit 7.2", y_spacing:str | "bays along project Y (m): same, 'fit 6' divides the boundary depth" default="fit 6"
# NODE_INPUTS: labels:str | "numbered or lettered grids along X (the other way gets the other)" default="numbers along X" options="numbers along X|letters along X"
# NODE_INPUTS: x_start:str | "first label of the grids along X ('1', '4', 'C', 'X1')" default="1", y_start:str | "first label of the grids along Y" default="A"
# NODE_INPUTS: skip_io:bool | "skip I and O in letters (they read as 1 and 0)" default=true, extension:float | "grid lines run past the outermost grids (m)" min=0 max=20 default=3
# NODE_INPUTS: bubble:float | "head diameter on paper (mm) at the drawing scale" min=4 max=30 step=0.5 default=10, ends:str | "heads at" default="both" options="both|start|end|none"
# NODE_INPUTS: scale:str | "drawing scale of the heads and dimensions" default="site" options="site|1:50|1:100|1:200|1:500"
# NODE_INPUTS: custom:list[Curve] | "extra grids: angled or curved curves (optional)", custom_names:list[str] | "names of the custom grids (default G1, G2 ...)"
# NODE_INPUTS: dimensions:bool | "bay and overall dimension strings (mm) on the start sides" default=true
# NODE_OUTPUTS: grids:list[str] | "grid records: wire into the building nodes' grids input", lines:list[Curve] | "grid lines", heads:list[Curve] | "bubbles: circle and name"
# NODE_OUTPUTS: names:list[str] | "one per grid line", points:list[Point3d] | "grid intersections", point_names:list[str] | "'A/1' ...", dims:list[Curve] | "dimension linework"
# NODE_OUTPUTS: outline:Curve | "footprint: the rectangle on the outermost grids, for walls, slabs, roofs and levels' outline", edges:list[Curve] | "the footprint's sides as wall lines (exterior on their left, as walls reads them): front, left, back, right", info:str""",
    Manual_0_Name="x_spacing",
    Manual_0_Value="\"3x4\"",
    Manual_1_Name="y_spacing",
    Manual_1_Value="\"2x4.5\"",
    ScriptRef="repo:suite/grids.py",
    ShowControls=True)  # -> Grids, Lines, Heads, Names, Points, Point_names, Dims, Outline, Edges, Info
levels = Alien(
    Outline=grids.Outline,
    Site=bim_site.Site,
    HeaderSnapshot="""# NODE_INPUTS: count:int | "storeys from the ground up" min=1 max=100 default=4, height:float | "floor-to-floor height (m)" min=0.5 max=20 default=3.2
# NODE_INPUTS: heights:list[str] | "per-storey heights (m), from the lowest up, e.g. '4.5, 3, , 3.6' (a blank keeps height)"
# NODE_INPUTS: base:float | "ground level above the site origin (m)" min=-20 max=50 default=0, outline:Curve | "floor plate to copy to every storey (optional; else the site boundary or a 20 x 12 m sample)"
# NODE_INPUTS: site:object | "site record from bim_site: places the levels, datum gives RLs, scale sizes the text"
# NODE_INPUTS: naming:str | "level names" default="Level 1" options="Level 1|L1|L01|Level 01|LVL 1|custom", prefix:str | "custom names: prefix + number, or # for the number ('Floor #', '##F' gives 01F)" default="Floor #"
# NODE_INPUTS: start:int | "number of the first numbered level" min=-5 max=100 default=1, ground:str | "name of the ground level" default="Ground" options="Ground|Ground Floor|GF|G|numbered"
# NODE_INPUTS: basements:int | "storeys below ground (Basement 1 is just below)" min=0 max=10 default=0, roof_level:bool | "add a Roof level on top of the last storey" default=true
# NODE_INPUTS: view:str | "level lines for which elevations" default="both" options="front (along X)|side (along Y)|both", ends:str | "level heads at" default="right" options="right|left|both|none"
# NODE_INPUTS: margin:float | "level lines run past the floor plates (m)" min=0 max=20 default=2, scale:str | "drawing scale of the annotation" default="site" options="site|1:50|1:100|1:200|1:500"
# NODE_INPUTS: text:float | "text height on paper (mm) at the drawing scale" min=1 max=10 step=0.5 default=3.5
# NODE_OUTPUTS: planes:list[Plane] | "one per storey", elevations:list[float] | "storey z (m)", floor_heights:list[float] | "floor-to-floor of each storey (m)"
# NODE_OUTPUTS: names:list[str] | "storey names", plates:list[Curve] | "floor plate at each storey", roof:Plane | "top of the last storey", total:float | "ground to roof (m)"
# NODE_OUTPUTS: levels:list[str] | "level records, storeys and roof: wire into the building nodes' levels input", lines:list[Curve] | "level lines for elevations and sections"
# NODE_OUTPUTS: heads:list[Curve] | "level heads: datum symbol, name and RL at the line ends", annotations:list[Curve] | "plan label on each level: 'LEVEL 1  RL +3.200'"
# NODE_OUTPUTS: labels:list[str] | "one per level", rl:list[float] | "reduced level of each level (m): datum + elevation", info:str""",
    Manual_0_Name="count",
    Manual_0_Value="2",
    Manual_1_Name="height",
    Manual_1_Value="3.0",
    ScriptRef="repo:suite/levels.py",
    ShowControls=True)  # -> Planes, Elevations, Floor_heights, Names, Plates, Roof, Total, Levels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
walls = Alien(
    Path=grids.Edges,
    Wall_type=wall_types.Wall_type,
    Levels=levels.Levels,
    Site=bim_site.Site,
    HeaderSnapshot="""# NODE_INPUTS: path:list[Curve] | "wall location lines: lines, polylines, arcs, splines, closed outlines (a sample room when unwired)"
# NODE_INPUTS: wall_type:list[object] | "wall_types record(s), one per path (the last repeats; default: generic 200 mm)"
# NODE_INPUTS: levels:list[object] | "level records (sample levels when unwired)"
# NODE_INPUTS: base:str | "base level: name, code or index (blank: the first); 'all' = every storey, or several with commas" default="", top:str | "top level: name, code or index (blank: the level above the base)" default=""
# NODE_INPUTS: height:float | "height (m); 0 = up to the top level" min=0 max=30 default=0, offset:float | "base offset from the base level (m)" min=-5 max=5 default=0
# NODE_INPUTS: location:str | "which line of the wall the path is" default="centre" options="centre|exterior|interior|core centre"
# NODE_INPUTS: flip:bool | "swap the exterior and interior sides" default=false, join:bool | "clean joins: mitre L corners, trim walls that butt into others" default=true
# NODE_INPUTS: cut:float | "plan cut height above the base level (m)" min=0 max=3 default=1.0, site:object | "site record (optional): places the sample room"
# NODE_OUTPUTS: walls:list[str] | "wall records (for doors and windows)", solids:list[Brep] | "one solid per layer per wall", materials:list[str] | "material per solid", colours:list[Color] | "colour per solid"
# NODE_OUTPUTS: plan:list[Curve] | "plan linework at the cut height: every layer boundary and the wall ends", centrelines:list[Curve] | "centre of each wall's thickness, at its base", info:str""",
    Manual_0_Name="base",
    Manual_0_Value="\"all\"",
    ScriptRef="repo:suite/walls.py",
    ShowControls=True)  # -> Walls, Solids, Materials, Colours, Plan, Centrelines, Info
roofs = Alien(
    Outline=grids.Outline,
    Levels=levels.Levels,
    Roof_type=roof_types.Roof_type,
    Site=bim_site.Site,
    HeaderSnapshot="""# NODE_INPUTS: outline:list[Curve] | "wall lines to roof over, closed, one roof each (a 10 x 7 m sample room when unwired)"
# NODE_INPUTS: levels:list[object] | "level records (sample levels when unwired)"
# NODE_INPUTS: level:str | "level the roof sits on (the top of the walls): name, code or index (blank: the top level)" default=""
# NODE_INPUTS: form:str | "roof form" default="hip" options="hip|gable|dutch gable|skillion|flat"
# NODE_INPUTS: pitch:float | "pitch (degrees); flat roofs: the fall written on the plan (5 or less)" min=0 max=75 default=22.5
# NODE_INPUTS: overhang:float | "eaves overhang past the wall line (m)" min=0 max=3 default=0.6, gable_overhang:float | "verge overhang at gable ends and skillion sides (m)" min=0 max=3 default=0.3
# NODE_INPUTS: ridge:str | "ridge direction for gable, dutch gable, skillion and flat: auto = along the long side; skillion and flat fall across it" default="auto" options="auto|x|y"
# NODE_INPUTS: flip:bool | "skillion and flat: fall the other way" default=false
# NODE_INPUTS: fascia:float | "fascia and barge board depth (m), with gutters on the eaves; 0 = none" min=0 max=0.6 default=0.2
# NODE_INPUTS: infill:float | "gable ends, skillion sides and high walls: infill up to the roof's underside, this thick (m), centred on the wall line; 0 = leave open" min=0 max=1 default=0.2
# NODE_INPUTS: roof_type:object | "roof_types record (default: metal deck)", site:object | "site record (optional): x/y and placement, north for face aspects, scale for plan text"
# NODE_OUTPUTS: roofs:list[str] | "roof records", solids:list[Brep] | "one solid per layer per roof part, then fascias, barge boards, gutters, gablets and wall infill", materials:list[str] | "material per solid", colours:list[Color] | "colour per solid"
# NODE_OUTPUTS: ridges:list[Curve] | "ridge lines (and a skillion's high edge)", hips:list[Curve] | "hip lines", valleys:list[Curve] | "valley lines", eaves:list[Curve] | "roof edges: eaves, verges (gable rakes) and gablet bases"
# NODE_OUTPUTS: plan:list[Curve] | "roof plan: eaves outline, ridges, hips, valleys, the wall line dashed, fall arrows with the pitch", area:list[float] | "area of each roof on the slope (m2)", info:str""",
    ScriptRef="repo:suite/roofs.py",
    ShowControls=True)  # -> Roofs, Solids, Materials, Colours, Ridges, Hips, Valleys, Eaves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
beams_columns = Alien(
    Grids=grids.Grids,
    Levels=levels.Levels,
    Site=bim_site.Site,
    HeaderSnapshot="""# NODE_INPUTS: grids:list[object] | "grid records (from grids); sample grids when unwired", levels:list[object] | "level records (from levels); sample levels when unwired"
# NODE_INPUTS: column:str | "column section: 310UC96.8, SHS 150x9, CHS 168.3x7.1, GL18 360x360, concrete 450x450, or a profile record from section_profile (blank: the material's default)" default=""
# NODE_INPUTS: beam:str | "beam section: 410UB53.7, 250PFC, RHS 200x100x6, LVL 360x63, concrete 600x400, or a profile record from section_profile (blank: the material's default)" default=""
# NODE_INPUTS: material:str | "frame material: picks the default sections and reads bare sizes like 400x400" default="steel" options="steel|timber|concrete"
# NODE_INPUTS: columns_at:str | "where columns go" default="all intersections" options="all intersections|perimeter|none", skip:str | "intersections left without a column, e.g. 'B/2, C/3'" default=""
# NODE_INPUTS: beams_on:str | "grid lines that get beams" default="both" options="both|letters|numbers|none"
# NODE_INPUTS: from_level:str | "lowest level: name, code or index (blank: the lowest)" default="", to_level:str | "top level (blank: the highest)" default=""
# NODE_INPUTS: rotation:float | "column rotation (degrees) on top of the grid's angle" min=-180 max=180 default=0, top_offset:float | "beam tops below each level (m), e.g. the slab thickness" min=0 max=1.5 default=0.15
# NODE_INPUTS: site:object | "site record (optional): unwired sample grids sit on its origin and rotation"
# NODE_OUTPUTS: members:list[str] | "member records: wire into structure_edit or connectors", solids:list[Brep] | "every member, in member order"
# NODE_OUTPUTS: columns:list[Brep], beams:list[Brep], axes:list[Curve] | "member centrelines", names:list[str] | "member ids, e.g. C-A/1-GF, B-L01-A-1/2"
# NODE_OUTPUTS: sections:list[str] | "section name per member", colours:list[Color] | "preview colour per member (wire with solids into Custom Preview)", info:str""",
    Manual_0_Name="columns_at",
    Manual_0_Value="\"perimeter\"",
    Manual_1_Name="top_offset",
    Manual_1_Value="0.2",
    Manual_2_Name="column",
    Manual_2_Value="\"SHS 89x5\"",
    Manual_3_Name="beam",
    Manual_3_Value="\"200UB25.4\"",
    ScriptRef="repo:suite/beams_columns.py",
    ShowControls=True)  # -> Members, Solids, Columns, Beams, Axes, Names, Sections, Colours, Info
stairs = Alien(
    Levels=levels.Levels,
    Stair_type=stair_types.Stair_type,
    Site=bim_site.Site,
    HeaderSnapshot="""# NODE_INPUTS: levels:list[object] | "level records (sample: 3 storeys at 3.2 m)", from_level:str | "lower level: name, code or index (blank: the lowest)" default=""
# NODE_INPUTS: to_level:str | "upper level: name, code or index (blank: the level above)" default="", height:float | "floor-to-floor height (m); 0 = from the levels" min=0 max=12 default=0
# NODE_INPUTS: base:list[Curve] | "base lines: each one's start is the foot of a stair, its direction the way up (sample: a line along X at the site origin)"
# NODE_INPUTS: align:str | "where the base line runs across the stair (looking up)" default="centre" options="centre|left edge|right edge"
# NODE_INPUTS: shape:str | "stair shape" default="straight" options="straight|L (quarter landing)|U (half landing)|spiral"
# NODE_INPUTS: turn:str | "L, U and spiral: the way the stair turns going up" default="left" options="left|right"
# NODE_INPUTS: width:float | "stair width (m): tread length; stringers sit outside it" min=0.5 max=4 default=1.2
# NODE_INPUTS: stair_type:object | "stair_type record from stair_types (default: concrete in-situ, public, 175/280)"
# NODE_INPUTS: landing:float | "landing depth (m) in the walking direction; 0 = the stair width (at least 0.75)" min=0 max=5 default=0
# NODE_INPUTS: split:int | "L and U: risers in the first flight (0 = half)" min=0 max=40 default=0
# NODE_INPUTS: well:float | "U: gap between the two flights; spiral: centre column radius (m)" min=0 max=2 default=0.1
# NODE_INPUTS: sides:str | "which stair sides get balustrade edges (the upper floor's void edges always do)" default="both" options="both|inner|outer|none"
# NODE_INPUTS: cut:float | "plan cut height above the lower level (m): treads above it are dashed" min=0.2 max=3 default=1.0
# NODE_INPUTS: site:object | "site record (optional): drawing scale for the plan symbols; places the sample base line"
# NODE_OUTPUTS: stairs:list[str] | "stair records", solids:list[Brep] | "flights (waist slab, or treads, risers and stringers), landings", colours:list[Color] | "colour per solid"
# NODE_OUTPUTS: plan:list[Curve] | "plan at the lower level: treads, walking line with UP and arrow, cut line with break; above the cut dashed"
# NODE_OUTPUTS: edges:list[Curve] | "balustrade lines: open stair sides on the nosing line (flat on landings), and the upper floor's void edges; the walkable side is on each curve's left"
# NODE_OUTPUTS: voids:list[Curve] | "floor opening at the upper level, closed: for the slabs node's openings"
# NODE_OUTPUTS: risers:list[int] | "risers per stair", riser:list[float] | "riser height per stair (mm)", going:list[float] | "going per stair (mm)", info:str""",
    Manual_0_Name="from_level",
    Manual_0_Value="\"0\"",
    Manual_1_Name="to_level",
    Manual_1_Value="\"1\"",
    Manual_2_Name="base",
    Manual_2_Value="[[449.99999999999994,8150.0,0],[1450.0000000000002,8150.0,0]]",
    Manual_3_Name="width",
    Manual_3_Value="1.0",
    ScriptRef="repo:suite/stairs.py",
    ShowControls=True)  # -> Stairs, Solids, Colours, Plan, Edges, Voids, Risers, Riser, Going, Info
slabs = Alien(
    Outline=grids.Outline,
    Levels=levels.Levels,
    Slab_type=slab_types.Slab_type,
    Openings=stairs.Voids,
    Site=bim_site.Site,
    HeaderSnapshot="""# NODE_INPUTS: outline:list[Curve] | "slab outlines, closed (a 10 x 7 m sample room when unwired); outlines at several heights each go to the level at their height"
# NODE_INPUTS: levels:list[object] | "level records (sample levels when unwired)"
# NODE_INPUTS: which:str | "levels to slab: floors (all but the top level, which is the roof's), all, suspended (not the lowest or top), indices from 0 = lowest ('1-3'), names or codes ('L01, Level 2')" default="floors"
# NODE_INPUTS: slab_type:list[object] | "slab_types record(s), one per chosen level from the lowest (the last repeats; default: concrete 200)"
# NODE_INPUTS: offset:float | "edge offset from the outline (m): + outward (e.g. to the outer face of the walls), - inward" min=-2 max=5 default=0
# NODE_INPUTS: openings:list[Curve] | "holes, closed curves: stair voids (stairs.voids), shafts, atria; ones crossing the edge cut notches"
# NODE_INPUTS: through:str | "which slabs an opening cuts: its level = the level at the curve's height; auto = that, unless it lies at the outline's height (a sketch: then every slab)" default="auto" options="auto|every level|its level"
# NODE_INPUTS: setdown:float | "top of slab below the level (m), e.g. 0.05 for a wet area" min=0 max=1 default=0
# NODE_INPUTS: site:object | "site record (optional): places the sample outline"
# NODE_OUTPUTS: slabs:list[str] | "slab records", solids:list[Brep] | "one solid per layer per slab", materials:list[str] | "material per solid", colours:list[Color] | "colour per solid"
# NODE_OUTPUTS: edges:list[Curve] | "slab edges at the top: outer edges and void edges (for balustrades)", plan:list[Curve] | "plan linework at the top: slab edges and a cross in each void"
# NODE_OUTPUTS: area:list[float] | "net area of each slab (m2)", info:str""",
    Manual_0_Name="offset",
    Manual_0_Value="0.125",
    ScriptRef="repo:suite/slabs.py",
    ShowControls=True)  # -> Slabs, Solids, Materials, Colours, Edges, Plan, Area, Info
doors = Alien(
    Walls=walls.Walls,
    HeaderSnapshot="""# NODE_INPUTS: walls:list[object] | "wall records from walls (or from windows / another doors node); a sample wall when unwired"
# NODE_INPUTS: wall:str | "which wall: id or index, several with commas, or 'all' (blank: the first; points: the nearest)" default=""
# NODE_INPUTS: positions:list[str] | "door centres along the wall (m): '1.2, 4.5'; negative = back from the end, '50%' = halfway (blank: mid-wall)" default=""
# NODE_INPUTS: points:list[Point3d] | "or points: each door goes to the nearest wall"
# NODE_INPUTS: width:float | "overall width, frame included (m)" min=0.5 max=6 default=0.9, height:float | "overall height from the floor (m)" min=1.5 max=4 default=2.1
# NODE_INPUTS: family:str | "door type" default="single swing" options="single swing|double swing|sliding|pocket|bifold"
# NODE_INPUTS: hand:str | "hinge side seen from the side it opens into (sliding, pocket, bifold: the side it opens towards)" default="left" options="left|right"
# NODE_INPUTS: swing:str | "the side it opens into (in = the wall's interior)" default="in" options="in|out"
# NODE_INPUTS: frame:float | "frame (jamb) width (m)" min=0.02 max=0.2 default=0.04
# NODE_INPUTS: design:list[Geometry] | "a generated leaf design (e.g. object_3d parts), fitted into each leaf (optional)"
# NODE_INPUTS: name:str | "door type name for the library (blank: from the family, size and hand)" default="", save:bool | "add this type to the Alien library" button
# NODE_OUTPUTS: openings:list[str] | "door records", walls:list[str] | "wall records with every opening so far (wire into windows)", solids:list[Brep] | "the walls' layer solids with every opening cut", colours:list[Color] | "colour per solid"
# NODE_OUTPUTS: parts:list[Geometry] | "frames, leaves and glass together", part_colours:list[Color] | "colour per part", frames:list[Brep], leaves:list[Geometry] | "leaves (or the fitted design)", glass:list[Brep]
# NODE_OUTPUTS: plan:list[Curve] | "walls cut at the plan height, open at the doors", symbols:list[Curve] | "plan symbols: frame, leaf drawn open, swing arc", reflected:list[Curve] | "seen from below (reflected ceiling plan): head, frame, closed leaves", elevation:list[Curve] | "on the exterior face: outline and opening lines (dashed V points to the hinges)", info:str""",
    Manual_0_Name="wall",
    Manual_0_Value="\"0\"",
    Manual_1_Name="positions",
    Manual_1_Value="\"6\"",
    ScriptRef="repo:suite/doors.py",
    ShowControls=True)  # -> Openings, Walls, Solids, Colours, Parts, Part_colours, Frames, Leaves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
balustrades = Alien(
    Path=stairs.Edges,
    Balustrade_type=balustrade_types.Balustrade_type,
    Levels=levels.Levels,
    Site=bim_site.Site,
    HeaderSnapshot="""# NODE_INPUTS: path:list[Curve] | "lines to guard: slab edges, stairs' edges (they keep their slope), polylines, arcs, closed outlines (a sample when unwired)"
# NODE_INPUTS: balustrade_type:object | "balustrade_type record from balustrade_types (default: glass and posts, 1.0 m)"
# NODE_INPUTS: base:str | "blank: follow each path's own z (stair edges); else a level name, code or index, or an elevation like 3.2 (m)" default=""
# NODE_INPUTS: levels:list[object] | "level records, for a level named in base (sample levels when unwired)"
# NODE_INPUTS: height:float | "height override (m), floors and flights alike; 0 = the type's" min=0 max=2 default=0
# NODE_INPUTS: offset:float | "move off the path (m): + = to its left (stairs' edges: onto the stair), inside a closed outline" min=-1 max=1 default=0
# NODE_INPUTS: end_posts:bool | "posts at the ends of open paths" default=true
# NODE_INPUTS: fall:float | "drop beside the balustrade (m), for the NCC climbing check on rails and wires; 0 = not checked" min=0 max=100 default=0
# NODE_INPUTS: site:object | "site record (optional): places the sample"
# NODE_OUTPUTS: balustrades:list[str] | "balustrade records", solids:list[Brep] | "posts, infill (glass, bars, rails, wires, sheet), handrails", colours:list[Color] | "colour per solid"
# NODE_OUTPUTS: plan:list[Curve] | "plan: posts and the balustrade's faces, at each balustrade's lowest point", elevation:list[Curve] | "front outlines of every part, in place (seen square-on they are the elevation)"
# NODE_OUTPUTS: handrail:list[Curve] | "handrail centrelines", info:str""",
    ScriptRef="repo:suite/balustrades.py",
    ShowControls=True)  # -> Balustrades, Solids, Colours, Plan, Elevation, Handrail, Info
windows = Alien(
    Walls=doors.Walls,
    HeaderSnapshot="""# NODE_INPUTS: walls:list[object] | "wall records from walls or doors (or another windows node); a sample wall when unwired"
# NODE_INPUTS: wall:str | "which wall: id or index, several with commas, or 'all' (blank: the first; points: the nearest)" default=""
# NODE_INPUTS: positions:list[str] | "window centres along the wall (m): '1.2, 4.5'; negative = back from the end, '50%' = halfway (blank: mid-wall)" default="25%, 75%"
# NODE_INPUTS: points:list[Point3d] | "or points: each window goes to the nearest wall"
# NODE_INPUTS: width:float | "overall width, frame included (m)" min=0.3 max=6 default=1.2, height:float | "overall height (m)" min=0.3 max=4 default=1.2
# NODE_INPUTS: sill:float | "sill height above the floor (m)" min=0 max=3 default=0.9
# NODE_INPUTS: family:str | "window type" default="awning" options="fixed|casement|awning|hopper|sliding|double hung"
# NODE_INPUTS: hand:str | "casement: hinge side seen from the side it opens into; sliding: the side it opens towards" default="left" options="left|right"
# NODE_INPUTS: swing:str | "the side sashes open into" default="out" options="in|out"
# NODE_INPUTS: frame:float | "frame width (m)" min=0.02 max=0.2 default=0.05
# NODE_INPUTS: design:list[Geometry] | "a generated sash design (e.g. object_3d parts), fitted into each sash (optional)"
# NODE_INPUTS: name:str | "window type name for the library (blank: from the family, size and hand)" default="", save:bool | "add this type to the Alien library" button
# NODE_OUTPUTS: openings:list[str] | "window records", walls:list[str] | "wall records with every opening so far", solids:list[Brep] | "the walls' layer solids with every opening cut", colours:list[Color] | "colour per solid"
# NODE_OUTPUTS: parts:list[Geometry] | "frames, sashes and glass together", part_colours:list[Color] | "colour per part", frames:list[Brep], sashes:list[Geometry] | "sashes (or the fitted design)", glass:list[Brep]
# NODE_OUTPUTS: plan:list[Curve] | "walls cut at the plan height, open at the windows", symbols:list[Curve] | "plan symbols: frame and sashes (the opening dashed when above the cut)", reflected:list[Curve] | "seen from below (reflected ceiling plan): head, frame, sashes", elevation:list[Curve] | "on the exterior face: outline, sashes and opening lines (dashed V points to the hinges)", info:str""",
    Manual_0_Name="wall",
    Manual_0_Value="\"0, 2, 4, 6\"",
    Manual_1_Name="positions",
    Manual_1_Value="\"2, 6, 10\"",
    ScriptRef="repo:suite/windows.py",
    ShowControls=True)  # -> Openings, Walls, Solids, Colours, Parts, Part_colours, Frames, Sashes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
windows_2 = Alien(
    Walls=windows.Walls,
    HeaderSnapshot="""# NODE_INPUTS: walls:list[object] | "wall records from walls or doors (or another windows node); a sample wall when unwired"
# NODE_INPUTS: wall:str | "which wall: id or index, several with commas, or 'all' (blank: the first; points: the nearest)" default=""
# NODE_INPUTS: positions:list[str] | "window centres along the wall (m): '1.2, 4.5'; negative = back from the end, '50%' = halfway (blank: mid-wall)" default="25%, 75%"
# NODE_INPUTS: points:list[Point3d] | "or points: each window goes to the nearest wall"
# NODE_INPUTS: width:float | "overall width, frame included (m)" min=0.3 max=6 default=1.2, height:float | "overall height (m)" min=0.3 max=4 default=1.2
# NODE_INPUTS: sill:float | "sill height above the floor (m)" min=0 max=3 default=0.9
# NODE_INPUTS: family:str | "window type" default="awning" options="fixed|casement|awning|hopper|sliding|double hung"
# NODE_INPUTS: hand:str | "casement: hinge side seen from the side it opens into; sliding: the side it opens towards" default="left" options="left|right"
# NODE_INPUTS: swing:str | "the side sashes open into" default="out" options="in|out"
# NODE_INPUTS: frame:float | "frame width (m)" min=0.02 max=0.2 default=0.05
# NODE_INPUTS: design:list[Geometry] | "a generated sash design (e.g. object_3d parts), fitted into each sash (optional)"
# NODE_INPUTS: name:str | "window type name for the library (blank: from the family, size and hand)" default="", save:bool | "add this type to the Alien library" button
# NODE_OUTPUTS: openings:list[str] | "window records", walls:list[str] | "wall records with every opening so far", solids:list[Brep] | "the walls' layer solids with every opening cut", colours:list[Color] | "colour per solid"
# NODE_OUTPUTS: parts:list[Geometry] | "frames, sashes and glass together", part_colours:list[Color] | "colour per part", frames:list[Brep], sashes:list[Geometry] | "sashes (or the fitted design)", glass:list[Brep]
# NODE_OUTPUTS: plan:list[Curve] | "walls cut at the plan height, open at the windows", symbols:list[Curve] | "plan symbols: frame and sashes (the opening dashed when above the cut)", reflected:list[Curve] | "seen from below (reflected ceiling plan): head, frame, sashes", elevation:list[Curve] | "on the exterior face: outline, sashes and opening lines (dashed V points to the hinges)", info:str""",
    Manual_0_Name="wall",
    Manual_0_Value="\"1, 3, 5, 7\"",
    Manual_1_Name="positions",
    Manual_1_Value="\"2.25, 6.75\"",
    ScriptRef="repo:suite/windows.py",
    ShowControls=True)  # -> Openings, Walls, Solids, Colours, Parts, Part_colours, Frames, Sashes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
preview = CustomPreview(
    Geometry=[windows_2.Solids, doors.Parts, windows.Parts, windows_2.Parts, slabs.Solids, roofs.Solids, beams_columns.Solids, stairs.Solids, balustrades.Solids],
    Material=[windows_2.Colours, doors.Part_colours, windows.Part_colours, windows_2.Part_colours, slabs.Colours, roofs.Colours, beams_columns.Colours, stairs.Colours, balustrades.Colours])

# ----
exploded_axo = Alien(
    Geometry=[windows_2.Solids, doors.Parts, windows.Parts, windows_2.Parts, slabs.Solids, roofs.Solids, stairs.Solids, balustrades.Solids],
    HeaderSnapshot="""# NODE_INPUTS: geometry:tree[Geometry] | "parts: one branch per group (e.g. per level), or a flat list exploded part by part; unwired: a sample building"
# NODE_INPUTS: mode:str | "how the groups move apart" default="vertical stack" options="vertical stack|height bands|along vector|radial"
# NODE_INPUTS: spacing:float | "gap opened between neighbouring groups (m); radial: how far the outermost group moves" min=0 max=50 default=3
# NODE_INPUTS: axis:Vector3d | "direction for 'along vector' (unwired: world Z)", band:float | "band height for 'height bands' (m)" min=0.1 max=50 default=3.2
# NODE_INPUTS: keep_base:bool | "the first (lowest) group stays where it is" default=true, beside:bool | "draw the result beside the original (along +X) instead of over it" default=false
# NODE_INPUTS: leaders:str | "dashed explosion lines between where each group was and where it is" default="corners" options="none|corners|centres"
# NODE_INPUTS: names:list[str] | "a label per group, drawn beside it (in branch order; height bands: bottom up)"
# NODE_INPUTS: angle:str | "isometric view from" default="SW" options="SW|SE|NE|NW"
# NODE_INPUTS: display:str | "display mode saved with the named view" default="Shaded", name:str | "named view name" default="Alien axo · Exploded"
# NODE_INPUTS: view:bool | "create (or replace) a parallel isometric named view framing the result" button
# NODE_OUTPUTS: exploded | "the parts moved apart, in the same tree structure as geometry", lines:list[Curve] | "dashed explosion lines", labels:list[Curve] | "group labels as curves, facing the view"
# NODE_OUTPUTS: transforms:list[Transform] | "the move of each group (branch order; a flat list: part order; height bands: bottom up)", info:str""",
    Manual_0_Name="mode",
    Manual_0_Value="\"height bands\"",
    Manual_1_Name="band",
    Manual_1_Value="3.0",
    Manual_2_Name="spacing",
    Manual_2_Value="3.5",
    Manual_3_Name="beside",
    Manual_3_Value="true",
    Manual_4_Name="names",
    Manual_4_Value="[\"Ground floor\",\"Level 1\",\"Roof\"]",
    ScriptRef="repo:suite/exploded_axo.py",
    ShowControls=True)  # -> Exploded, Lines, Labels, Transforms, Info
preview_2 = CustomPreview(
    Geometry=exploded_axo.Exploded,
    Material=[windows_2.Colours, doors.Part_colours, windows.Part_colours, windows_2.Part_colours, slabs.Colours, roofs.Colours, stairs.Colours, balustrades.Colours])
preview_3 = CustomPreview(Geometry=[exploded_axo.Lines, exploded_axo.Labels], Material=ColourSwatch(SwatchColor=RGB(40, 40, 40)))
