# Grasshopper definition 08_framed_tower.gh (Grasshopper 1.0.8)
# plug-ins: Alien

bim_site = Alien(
    HeaderSnapshot="""# NODE_INPUTS: name:str | "project name" default="Project", boundary:list[Curve] | "site boundary, e.g. vic_site_map's site (optional; several lots are joined)"
# NODE_INPUTS: origin:Point3d | "project base point (optional; else set by anchor)", anchor:str | "where the origin goes when none is wired" default="corner" options="corner|centre|world origin"
# NODE_INPUTS: rotation:float | "project grid rotation (deg, CCW from world X); with align, turns the aligned grid further" min=-180 max=180 default=0 decimals=1
# NODE_INPUTS: align:str | "take the grid direction from the boundary" default="off" options="off|long axis|longest edge"
# NODE_INPUTS: north:float | "true north (deg, CCW from world +Y; 0 for vic_site_map)" min=-180 max=180 default=0 decimals=1
# NODE_INPUTS: datum:float | "AHD (m) of model z = 0: wire vic_site_map's datum" min=-20 max=2000 default=0 decimals=3
# NODE_INPUTS: scale:str | "drawing scale for the suite's annotation (levels, grids, symbols)" default="1:100" options="1:50|1:100|1:200|1:500|1:1000"
# NODE_OUTPUTS: site:str | "site record: wire into the building nodes' site input", plane:Plane | "project plane: at the origin, X along the grid"
# NODE_OUTPUTS: boundary:list[Curve] | "the joined site boundary", arrow:list[Curve] | "north point (true north; a PN tick when the grid is turned)"
# NODE_OUTPUTS: marker:list[Curve] | "project base point: circle, cross, X/Y axes, datum", info:str""",
    Manual_0_Name="name",
    Manual_0_Value="\"Tower\"",
    ScriptRef="repo:suite/bim_site.py",
    ShowControls=True)  # -> Site, Plane, Boundary, Arrow, Marker, Info
grids = Alien(
    Site=bim_site.Site,
    HeaderSnapshot="""# NODE_INPUTS: site:object | "site record from bim_site: grids start at its origin and run along its rotation"
# NODE_INPUTS: boundary:Curve | "optional boundary curve: overrides the site's boundary; grids fit its footprint"
# NODE_INPUTS: fit:bool | "fit grids to the boundary footprint" default=true, margin:float | "inset from the boundary (m)" min=0 max=20 default=0
# NODE_INPUTS: x_spacing:str | "bays along project X (m): '7.2, 7.2, 8.4', '3x7.2', or 'fit' / 'fit 7.2' to divide the boundary width" default="fit 7.2", y_spacing:str | "bays along project Y (m): same, 'fit 6' divides the boundary depth" default="fit 6"
# NODE_INPUTS: labels:str | "numbered or lettered grids along X (the other way gets the other)" default="numbers along X" options="numbers along X|letters along X"
# NODE_INPUTS: x_start:str | "first label of the grids along X ('1', '4', 'C', 'X1')" default="1", y_start:str | "first label of the grids along Y" default="A"
# NODE_INPUTS: skip_io:bool | "skip I and O in letters (they read as 1 and 0)" default=true, extension:float | "grid lines run past the outermost grids (m)" min=0 max=20 default=3
# NODE_INPUTS: bubble:float | "head diameter on paper (mm) at the drawing scale" min=4 max=30 step=0.5 default=10, ends:str | "heads at" default="both" options="both|start|end|none"
# NODE_INPUTS: scale:str | "drawing scale of the heads and dimensions" default="site" options="site|1:50|1:100|1:200|1:500"
# NODE_INPUTS: custom:list[Curve] | "extra grids: angled or curved curves (optional)", custom_names:list[str] | "names of the custom grids (default G1, G2 ...)"
# NODE_INPUTS: dimensions:bool | "bay and overall dimension strings (mm) on the start sides" default=true
# NODE_OUTPUTS: grids:list[str] | "grid records: wire into the building nodes' grids input", lines:list[Curve] | "grid lines", heads:list[Curve] | "bubbles: circle and name"
# NODE_OUTPUTS: names:list[str] | "one per grid line", points:list[Point3d] | "grid intersections", point_names:list[str] | "'A/1' ...", dims:list[Curve] | "dimension linework"
# NODE_OUTPUTS: outline:Curve | "footprint: the rectangle on the outermost grids, for walls, slabs, roofs and levels' outline", edges:list[Curve] | "the footprint's sides as wall lines (exterior on their left, as walls reads them): front, left, back, right", info:str""",
    Manual_0_Name="x_spacing",
    Manual_0_Value="\"4x8.4\"",
    Manual_1_Name="y_spacing",
    Manual_1_Value="\"3x8.4\"",
    ScriptRef="repo:suite/grids.py",
    ShowControls=True)  # -> Grids, Lines, Heads, Names, Points, Point_names, Dims, Outline, Edges, Info
# Framed tower
# Ten storeys on a 4 x 3 bay grid (8.4 m): a steel frame at every grid intersection, post-tensioned slabs
# 0.45 m past the grid, and a curtain wall 0.7 m out with transoms at each slab edge. Change the storeys on
# levels or the bays on grids and everything follows.
levels = Alien(
    Outline=grids.Outline,
    Site=bim_site.Site,
    HeaderSnapshot="""# NODE_INPUTS: count:int | "storeys from the ground up" min=1 max=100 default=4, height:float | "floor-to-floor height (m)" min=0.5 max=20 default=3.2
# NODE_INPUTS: heights:list[str] | "per-storey heights (m), from the lowest up, e.g. '4.5, 3, , 3.6' (a blank keeps height)"
# NODE_INPUTS: base:float | "ground level above the site origin (m)" min=-20 max=50 default=0, outline:Curve | "floor plate to copy to every storey (optional; else the site boundary or a 20 x 12 m sample)"
# NODE_INPUTS: site:object | "site record from bim_site: places the levels, datum gives RLs, scale sizes the text"
# NODE_INPUTS: naming:str | "level names" default="Level 1" options="Level 1|L1|L01|Level 01|LVL 1|custom", prefix:str | "custom names: prefix + number, or # for the number ('Floor #', '##F' gives 01F)" default="Floor #"
# NODE_INPUTS: start:int | "number of the first numbered level" min=-5 max=100 default=1, ground:str | "name of the ground level" default="Ground" options="Ground|Ground Floor|GF|G|numbered"
# NODE_INPUTS: basements:int | "storeys below ground (Basement 1 is just below)" min=0 max=10 default=0, roof_level:bool | "add a Roof level on top of the last storey" default=true
# NODE_INPUTS: view:str | "level lines for which elevations" default="both" options="front (along X)|side (along Y)|both", ends:str | "level heads at" default="right" options="right|left|both|none"
# NODE_INPUTS: margin:float | "level lines run past the floor plates (m)" min=0 max=20 default=2, scale:str | "drawing scale of the annotation" default="site" options="site|1:50|1:100|1:200|1:500"
# NODE_INPUTS: text:float | "text height on paper (mm) at the drawing scale" min=1 max=10 step=0.5 default=3.5
# NODE_OUTPUTS: planes:list[Plane] | "one per storey", elevations:list[float] | "storey z (m)", floor_heights:list[float] | "floor-to-floor of each storey (m)"
# NODE_OUTPUTS: names:list[str] | "storey names", plates:list[Curve] | "floor plate at each storey", roof:Plane | "top of the last storey", total:float | "ground to roof (m)"
# NODE_OUTPUTS: levels:list[str] | "level records, storeys and roof: wire into the building nodes' levels input", lines:list[Curve] | "level lines for elevations and sections"
# NODE_OUTPUTS: heads:list[Curve] | "level heads: datum symbol, name and RL at the line ends", annotations:list[Curve] | "plan label on each level: 'LEVEL 1  RL +3.200'"
# NODE_OUTPUTS: labels:list[str] | "one per level", rl:list[float] | "reduced level of each level (m): datum + elevation", info:str""",
    Manual_0_Name="count",
    Manual_0_Value="10",
    Manual_1_Name="height",
    Manual_1_Value="3.6",
    ScriptRef="repo:suite/levels.py",
    ShowControls=True)  # -> Planes, Elevations, Floor_heights, Names, Plates, Roof, Total, Levels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
beams_columns = Alien(
    Grids=grids.Grids,
    Levels=levels.Levels,
    Site=bim_site.Site,
    HeaderSnapshot="""# NODE_INPUTS: grids:list[object] | "grid records (from grids); sample grids when unwired", levels:list[object] | "level records (from levels); sample levels when unwired"
# NODE_INPUTS: column:str | "column section: 310UC96.8, SHS 150x9, CHS 168.3x7.1, GL18 360x360, concrete 450x450, or a profile record from section_profile (blank: the material's default)" default=""
# NODE_INPUTS: beam:str | "beam section: 410UB53.7, 250PFC, RHS 200x100x6, LVL 360x63, concrete 600x400, or a profile record from section_profile (blank: the material's default)" default=""
# NODE_INPUTS: material:str | "frame material: picks the default sections and reads bare sizes like 400x400" default="steel" options="steel|timber|concrete"
# NODE_INPUTS: columns_at:str | "where columns go" default="all intersections" options="all intersections|perimeter|none", skip:str | "intersections left without a column, e.g. 'B/2, C/3'" default=""
# NODE_INPUTS: beams_on:str | "grid lines that get beams" default="both" options="both|letters|numbers|none"
# NODE_INPUTS: from_level:str | "lowest level: name, code or index (blank: the lowest)" default="", to_level:str | "top level (blank: the highest)" default=""
# NODE_INPUTS: rotation:float | "column rotation (degrees) on top of the grid's angle" min=-180 max=180 default=0, top_offset:float | "beam tops below each level (m), e.g. the slab thickness" min=0 max=1.5 default=0.15
# NODE_INPUTS: site:object | "site record (optional): unwired sample grids sit on its origin and rotation"
# NODE_OUTPUTS: members:list[str] | "member records: wire into structure_edit or connectors", solids:list[Brep] | "every member, in member order"
# NODE_OUTPUTS: columns:list[Brep], beams:list[Brep], axes:list[Curve] | "member centrelines", names:list[str] | "member ids, e.g. C-A/1-GF, B-L01-A-1/2"
# NODE_OUTPUTS: sections:list[str] | "section name per member", colours:list[Color] | "preview colour per member (wire with solids into Custom Preview)", info:str""",
    Manual_0_Name="top_offset",
    Manual_0_Value="0.25",
    ScriptRef="repo:suite/beams_columns.py",
    ShowControls=True)  # -> Members, Solids, Columns, Beams, Axes, Names, Sections, Colours, Info
slab_types = Alien(
    HeaderSnapshot="""# NODE_INPUTS: preset:str | "a common floor build-up, or custom (from layers)" default="concrete 200" options="concrete 200|post-tensioned 250|hollowcore 200 + topping|CLT 180 + screed|timber joist floor|waffle 300|steel deck composite 150|slab on ground 100|custom"
# NODE_INPUTS: name:str | "type name (blank: from the preset, finish and soffit)" default=""
# NODE_INPUTS: layers:list[str] | "layers top -> bottom, thickness in mm: 'screed 50; CLT 180*; plasterboard ceiling 13' (* = structure). Replaces the preset's layers when given" default=""
# NODE_INPUTS: finish:str | "floor finish laid on top" default="none" options="none|polished concrete|tiles|timber boards|carpet|vinyl|screed|raised floor"
# NODE_INPUTS: soffit:str | "underside: as built keeps the build-up's own; the others replace its ceiling" default="as built" options="as built|exposed|plasterboard|suspended ceiling|render|acoustic panels"
# NODE_INPUTS: plane:Plane | "where the swatch sits (default: world origin)", save:bool | "add this type to the Alien library" button
# NODE_OUTPUTS: slab_type:str | "slab_type record for slabs", names:list[str] | "layer names, top first", materials:list[str] | "layer materials", thicknesses:list[float] | "layer thicknesses (m)"
# NODE_OUTPUTS: total:float | "overall thickness (m)", swatch:list[Brep] | "a stepped sample, one solid per layer", colours:list[Color] | "colour per swatch solid", info:str""",
    Manual_0_Name="preset",
    Manual_0_Value="\"post-tensioned 250\"",
    ScriptRef="repo:suite/slab_types.py",
    ShowControls=True)  # -> Slab_type, Names, Materials, Thicknesses, Total, Swatch, Colours, Info
curtain_wall = Alien(
    Path=grids.Outline,
    Levels=levels.Levels,
    HeaderSnapshot="""# NODE_INPUTS: path:Curve | "base line in plan: the glazing line before offset; exterior on its right, closed outlines face out (sample: a 12 m line)", levels:list[object] | "level records (sample: 3 storeys at 3.2 m)"
# NODE_INPUTS: base:str | "base level: name, code, index or an elevation like 4.5 (blank = the lowest)" default="", top:str | "top level: name, code or index, -2 = second from the top (blank = the highest)" default=""
# NODE_INPUTS: height:float | "height above the base level (m); 0 = up to the top level" min=0 max=200 default=0
# NODE_INPUTS: panel:float | "panel width (m): mullion spacing" min=0.1 max=12 default=1.5, fit:str | "what happens to the remainder" default="equal divide" options="equal divide|fixed from start|centred"
# NODE_INPUTS: transom_heights:str | "transom heights (m), e.g. '1.2, 2.4'; '@1.5' = every 1.5 m; negative = down from the top" default="", measure:str | "transom heights are measured from" default="each storey" options="each storey|wall base"
# NODE_INPUTS: at_levels:bool | "a transom at every level (slab edge)" default=true
# NODE_INPUTS: profile:str | "mullion profile" default="box" options="box|I|T|round|fin|flat bar", width:float | "mullion face width (mm)" min=10 max=400 default=50, depth:float | "mullion depth (mm), perpendicular to the facade; round: the diameter" min=20 max=1000 default=150
# NODE_INPUTS: transom_profile:str | "transom profile" default="same" options="same|box|I|T|round|fin|flat bar", transom_width:float | "transom face height (mm); 0 = as the mullion" min=0 max=400 default=0, transom_depth:float | "transom depth (mm); 0 = as the mullion" min=0 max=1000 default=0
# NODE_INPUTS: glazing:float | "glass thickness (mm)" min=4 max=80 default=28, offset:float | "glazing line offset from the path (m); + = outwards" min=-2 max=2 default=0, flip:bool | "swap inside and outside" default=false
# NODE_INPUTS: truss:str | "trusses behind the mullions (inside face)" default="none" options="none|warren|pratt|howe|vierendeel", truss_depth:float | "truss depth, chord centre to chord centre (m)" min=0.2 max=4 default=0.8
# NODE_INPUTS: chord:str | "chord section in mm: depth x width [x wall], e.g. 'box 100x100', 'round 114x6', 'I 150x75'" default="box 100x100", web:str | "web section in mm, e.g. 'round 60', 'box 60x60'" default="round 60"
# NODE_INPUTS: cut:float | "plan cut height above the base (m)" min=0 max=100 default=1
# NODE_OUTPUTS: solids:list[Brep] | "mullions, transoms, frame, glass and trusses, in that order", colours:list[Color] | "preview colour per solid"
# NODE_OUTPUTS: mullions:list[Brep], transoms:list[Brep], frame:list[Brep] | "jambs, sills and heads", glass:list[Brep], trusses:list[Brep]
# NODE_OUTPUTS: plan:list[Curve] | "cut at the plan height: member outlines and glass", grid:list[Curve] | "the curtain grid on the glazing plane", panels:list[Brep] | "cell surfaces on the grid, facing out"
# NODE_OUTPUTS: records:list[str] | "curtain_wall record, then one curtain_panel per cell", info:str""",
    Manual_0_Name="offset",
    Manual_0_Value="0.7",
    Manual_1_Name="panel",
    Manual_1_Value="1.4",
    Manual_2_Name="width",
    Manual_2_Value="60",
    Manual_3_Name="depth",
    Manual_3_Value="180",
    ScriptRef="repo:suite/curtain_wall.py",
    ShowControls=True)  # -> Solids, Colours, Mullions, Transoms, Frame, Glass, Trusses, Plan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
slabs = Alien(
    Outline=grids.Outline,
    Levels=levels.Levels,
    Slab_type=slab_types.Slab_type,
    Site=bim_site.Site,
    HeaderSnapshot="""# NODE_INPUTS: outline:list[Curve] | "slab outlines, closed (a 10 x 7 m sample room when unwired); outlines at several heights each go to the level at their height"
# NODE_INPUTS: levels:list[object] | "level records (sample levels when unwired)"
# NODE_INPUTS: which:str | "levels to slab: floors (all but the top level, which is the roof's), all, suspended (not the lowest or top), indices from 0 = lowest ('1-3'), names or codes ('L01, Level 2')" default="floors"
# NODE_INPUTS: slab_type:list[object] | "slab_types record(s), one per chosen level from the lowest (the last repeats; default: concrete 200)"
# NODE_INPUTS: offset:float | "edge offset from the outline (m): + outward (e.g. to the outer face of the walls), - inward" min=-2 max=5 default=0
# NODE_INPUTS: openings:list[Curve] | "holes, closed curves: stair voids (stairs.voids), shafts, atria; ones crossing the edge cut notches"
# NODE_INPUTS: through:str | "which slabs an opening cuts: its level = the level at the curve's height; auto = that, unless it lies at the outline's height (a sketch: then every slab)" default="auto" options="auto|every level|its level"
# NODE_INPUTS: setdown:float | "top of slab below the level (m), e.g. 0.05 for a wet area" min=0 max=1 default=0
# NODE_INPUTS: site:object | "site record (optional): places the sample outline"
# NODE_OUTPUTS: slabs:list[str] | "slab records", solids:list[Brep] | "one solid per layer per slab", materials:list[str] | "material per solid", colours:list[Color] | "colour per solid"
# NODE_OUTPUTS: edges:list[Curve] | "slab edges at the top: outer edges and void edges (for balustrades)", plan:list[Curve] | "plan linework at the top: slab edges and a cross in each void"
# NODE_OUTPUTS: area:list[float] | "net area of each slab (m2)", info:str""",
    Manual_0_Name="which",
    Manual_0_Value="\"all\"",
    Manual_1_Name="offset",
    Manual_1_Value="0.45",
    ScriptRef="repo:suite/slabs.py",
    ShowControls=True)  # -> Slabs, Solids, Materials, Colours, Edges, Plan, Area, Info
preview = CustomPreview(
    Geometry=[beams_columns.Solids, slabs.Solids, curtain_wall.Solids],
    Material=[beams_columns.Colours, slabs.Colours, curtain_wall.Colours])
panel = Panel(curtain_wall.Info)
